# Grasshopper definition Shoe_Physical_Measurements.gh (Grasshopper 1.0.7)
# plug-ins: Pufferfish

# ---- group: Adjust mesh and move to center
neg = Negative(Value=Slider(1.78, range=0..10))
yz = YZPlane(Origin=Point(0, 0, 0))
geo = Geometry(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)
vec = VectorXYZ(XComponent=Slider(16, range=0..100), YComponent=0, ZComponent=neg)  # -> Vector, Length
msplit = MeshSplitPlane(Mesh=geo, Plane=yz)  # -> Above, Below
move = Move(Geometry=msplit.Below, Motion=vec.Vector)  # -> Geometry, Transform

# ---- group: Create Contours
panel = Panel("""1
2
4
6
8
10""")
planesrf = PlaneSurface(Plane=PlaneXY(0, 0, 0), XSize=Domain(-10, 10), YSize=Domain(-10, 10))
pl_offset = PlaneOffset(BasePlane=planesrf, Offset=panel)
sec = MeshPlane(Mesh=move.Geometry, Plane=pl_offset)
simplify = SimplifyCurve(Curve=sec)  # -> Curve, Simplified
explode = Explode(Curve=simplify.Curve, Recursive=True)  # -> Segments, Vertices
hull = ConvexHull(Points=explode.Vertices, Plane=PlaneXY(0, 0, 0))  # -> Hull, HullZ, Indices
crv = Curve(hull.HullZ)
reb = RebuildCurve(Curve=crv, Degree=Slider(4, range=0..10), Count=Slider(7, range=0..100), Tangents=False)

# ----
# Adjust the front width with the slider
width = Slider(7.29, range=0..20)

# ---- group: (Example) Modify contour points based on measurements
crveditpts = CurveEditPoints(Curve=reb, Knots=True)  # -> Points, Tangents, Parameters
simplify_2 = SimplifyTree(Tree=crveditpts.Points, Front=False)
branch = TreeBranch(Tree=simplify_2, Path=Slider(0, range=0..10), MaintainPaths=True)
branch_2 = TreeBranch(Tree=simplify_2, Path=Slider(1, range=0..10), MaintainPaths=True)
item = ListItem(List=branch, Index=0, Wrap=True)  # -> Item, Item1, Item2, Item3
item_2 = ListItem(List=branch_2, Index=0, Wrap=True)  # -> Item, Item1, Item2, Item3
pdecon = Deconstruct(Point=item.Item3)  # -> XComponent, YComponent, ZComponent
pdecon_2 = Deconstruct(Point=item_2.Item)  # -> XComponent, YComponent, ZComponent
pdecon_3 = Deconstruct(Point=item.Item)  # -> XComponent, YComponent, ZComponent
pdecon_4 = Deconstruct(Point=item_2.Item3)  # -> XComponent, YComponent, ZComponent
subtraction = Subtraction(A=pdecon.XComponent, B=pdecon_3.XComponent)
subtraction_2 = Subtraction(A=width, B=subtraction)
division = Division(A=subtraction_2, B=Slider(2, range=0..10))
merge = Merge(Data1=item.Item, Data2=item.Item3, Data3=item_2.Item, Data4=item_2.Item3)  # -> flatten(Result)
subtraction_3 = Subtraction(A=pdecon_3.XComponent, B=division)
addition = Addition(A=pdecon.XComponent, B=division)
subtraction_4 = Subtraction(A=pdecon_2.XComponent, B=division)
addition_2 = Addition(A=pdecon_4.XComponent, B=division)
pt = ConstructPoint(XCoordinate=subtraction_3, YCoordinate=pdecon_3.YComponent, ZCoordinate=pdecon_3.ZComponent)
pt_2 = ConstructPoint(XCoordinate=addition_2, YCoordinate=pdecon_4.YComponent, ZCoordinate=pdecon_4.ZComponent)
pt_3 = ConstructPoint(XCoordinate=subtraction_4, YCoordinate=pdecon_2.YComponent, ZCoordinate=pdecon_2.ZComponent)
pt_4 = ConstructPoint(XCoordinate=addition, YCoordinate=pdecon.YComponent, ZCoordinate=pdecon.ZComponent)
merge_2 = Merge(Data1=pt, Data2=pt_4, Data3=pt_3, Data4=pt_2)  # -> flatten(Result)
replace = ReplaceMembers(Set=simplify_2, Find=merge, Replace=merge_2)

# ----
intcrv = Interpolate(Vertices=replace, Degree=3, Periodic=False, KnotStyle=1)  # -> Curve, Length, Domain

# ---- group: Adding sole to the shoe
branch_3 = TreeBranch(Tree=intcrv.Curve, Path=Slider(0, range=0..10), MaintainPaths=True)
neg_2 = Negative(Value=Slider(0.89, range=0..10))
offset = OffsetCurve(Curve=branch_3, Distance=neg_2, Corners=1)
Z = UnitZ(Factor=Slider(-1, range=-1..0))
move_2 = Move(Geometry=offset, Motion=Z)  # -> Geometry, Transform
merge_3 = Merge(Data1=flatten(move_2.Geometry), Data2=flatten(intcrv.Curve))

# ---- group: Troubleshooting curve and creating loft
crv_2 = Curve(merge_3)
end = EndPoints(Curve=flatten(crv_2))  # -> Start, End
item_3 = ListItem(List=flatten(end.Start), Index=Slider(5, range=0..10), Wrap=True)
crv_cp = CurveClosestPoint(Point=item_3, Curve=flatten(crv_2))  # -> Point, Parameter, Distance
seam = Seam(Curve=flatten(crv_2), Seam=crv_cp.Parameter)
crv_3 = Curve(seam)
crv_4 = Curve(crv_3)
item_4 = ListItem(List=crv_4, Index=0, Wrap=True)
flip = FlipCurve(Curve=crv_4, Guide=item_4)  # -> Curve, Flag
crv_5 = Curve(flip.Curve)
reb_2 = RebuildCurve(Curve=crv_5, Degree=Slider(2, range=0..10), Count=Slider(10, range=0..100), Tangents=False)
cp = ControlPoints(Curve=reb_2)  # -> Points, Weights, Knots
loft = Loft(Curves=reb_2, Options={Adjust=False, Closed=False, LoftEnds=0, LoftSimp=0, LoftType=0, Rebuild=10, Refit=0.01})
end_2 = EndPoints(Curve=seam)  # -> Start, End

# ----
srf = Surface(loft)
capex = CapHolesEx(Brep=srf)  # -> Brep, Caps, Solid
preview = CustomPreview(Geometry=capex.Brep, Material=ColourSwatch(SwatchColor=RGB(107, 107, 107)))
