# Grasshopper definition Lesson_3_-_Rainbow_stacking_rings.gh (Grasshopper 1.0.7)
# plug-ins: Bifocals

position_first_ring = Slider(0, range=0..20)
thickness_of_rings = Slider(6, range=0..20)
number_of_rings = Slider(17, range=0..20)
radius_smallest_ring = Slider(12, range=0..20)
increase_in_radius = Slider(4, range=0..20)
# List of planes for position
series = Series(Start=position_first_ring, Step=thickness_of_rings, Count=number_of_rings)
# List of numbers for radius
series_2 = Series(Start=radius_smallest_ring, Step=increase_in_radius, Count=number_of_rings)  # -> reverse(Series)
pt = ConstructPoint(XCoordinate=0, YCoordinate=0, ZCoordinate=series)
bnd = Bounds(Numbers=series_2)
pln = Plane(pt)
# Remap to graph shape
remap = RemapNumbers(Value=series_2, Source=bnd, Target=Domain(0, 1))  # -> Mapped, Clipped
graph = GraphMapper(
    remap.Mapped,
    x0=0,
    x1=1,
    y0=0,
    y1=1,
    container_name="Bezier",
    cpx=[0, 0.1521739066, 0.6025363803, 1],
    cpy=[0, 0.3188405633, 1, 0.702898562])
remap_2 = RemapNumbers(Value=graph, Source=Domain(0, 1), Target=bnd)  # -> Mapped, Clipped
# Create circles
cir = Circle(Plane=pln, Radius=remap_2.Mapped)
bnd_2 = Bounds(Numbers=pt)
Z = UnitZ(Factor=thickness_of_rings)
# Generate color gradient
dedomain = DeconstructDomain(Domain=bnd_2)  # -> Start, End
# Create solid shape
extr = Extrude(Base=cir, Direction=Z)
cap = CapHoles(Brep=extr)
gradient = Gradient(
    LowerLimit=dedomain.Start,
    UpperLimit=dedomain.End,
    Parameter=pt,
    stops=[0: RGB(243, 57, 0), 0.1: RGB(236, 27, 60), 0.2: RGB(210, 0, 118), 0.3: RGB(103, 0, 120), 0.4: RGB(39, 72, 161), 0.5: RGB(1, 192, 229), 0.6: RGB(18, 178, 90), 0.7: RGB(79, 186, 8), 0.8: RGB(220, 237, 32), 0.9: RGB(247, 159, 20), 1: RGB(243, 57, 0)])
preview = CustomPreview(Geometry=cap, Material=gradient)
