# Grasshopper definition Lesson_2_-_assignment_starting_file.gh (Grasshopper 1.0.7)

# ----
# Create a single link first
link_width = Slider(5, range=0..10)
link_length = Slider(9.3, range=0..10)
fillet_radius = Slider(5, range=0..10)
neg = Negative(Value=link_width)
neg_2 = Negative(Value=link_length)
dom = ConstructDomain(DomainStart=neg, DomainEnd=link_width)
dom_2 = ConstructDomain(DomainStart=neg_2, DomainEnd=link_length)
rectangle = Rectangle(Plane=PlaneXY(0, 0, 0), XSize=dom, YSize=dom_2, Radius=fillet_radius)  # -> Rectangle, Length

# ----
# Hint!
# Consider using these components:
# Perp.
# frames
# Dispatch
# Pipe
# Orient
# Rotate
pframes = PerpFrames(Count=10, Align=True)  # -> Frames, Parameters
orient = Orient(Source=PlaneXY(0, 0, 0), Target=PlaneXY(0, 0, 0))  # -> Geometry, Transform
dispatch = Dispatch(DispatchPattern=[True, False])  # -> ListA, ListB
pipe = Pipe(Radius=1, Caps=0)
rotate = Rotate(Angle=1.570796327, Plane=PlaneXY(0, 0, 0))  # -> Geometry, Transform

# ----
# Import a curve for the chain
crv = Curve()
