# Grasshopper definition Grasshopper_gcode_generation_template.gh (Grasshopper 1.0.7)

# ---- group: Input Geometry for Slicing
cyl = Cylinder(Base=PlaneXY(0, 0, 0), Radius=Slider(20, range=0..100), Length=Slider(40, range=0..100))
geo = Geometry(cyl)

# ---- group: Placing Geometry on Center of Print Bed / Bed size
X = Slider(216, range=0..500)
Y = Slider(216, range=0..500)

# ---- group: Creating Vertical Contours of the Geometry
Z = UnitZ(Factor=1)
contour = Contour(Shape=geo, Point=Point(0, 0, 0), Direction=Z, Distance=Slider(0.53, range=0..1))

# ---- group: Placing Geometry on Center of Print Bed
move_to_center = MoveToCenter(max_x=X, G=contour, max_y=Y)

# ---- group: Dividing Contours into Small Segments
divide = DivideCurve(Curve=move_to_center, Count=Slider(14, range=0..100), Kinks=False)  # -> Points, Tangents, Parameters
flatten = FlattenTree(Tree=divide.Points, Path="{0}")

# ----
panel = Panel(divide.Points)
panel_2 = Panel(flatten)

# ---- group: Calculating Length of Segments
pline = PolyLine(Vertices=flatten, Closed=False)
explode = Explode(Curve=pline, Recursive=True)  # -> Segments, Vertices
len = Length(Curve=explode.Segments)

# ---- group: Extrusion amount
layer_heigth = Slider(0.1, range=0..1)
line_width = Slider(0.4, range=0..1)
filament_diameter = Slider(2.85, range=0..4)
flow = Flow(
    layer_height=layer_heigth,
    line_width=line_width,
    multiplier=Slider(1, range=0..100),
    filament_diameter=filament_diameter)
multiplication = Multiplication(A=len, B=flow)

# ---- group: Generating G-code for Printing Segments / Converting from Relative to Absolute Extrusion
ma = MassAddition(Input=multiplication)  # -> Result, PartialResults

# ---- group: Generating G-code for Printing Segments
speed_mm_s = Slider(40, range=0..100)
pdecon = Deconstruct(Point=flatten)  # -> XComponent, YComponent, ZComponent
addition = Addition(A=pdecon.ZComponent, B=0.27)
mm_min = Multiplication(A=speed_mm_s, B=60)
g1 = Text("G1 ")
F = Text("F")
X_2 = Text(" X")
E = Text(" E")
Y_2 = Text(" Y")
Z_2 = Text(" Z")
concat = Concatenate(
    FragmentH=g1,
    FragmentG=F,
    FragmentL=mm_min,
    FragmentA=X_2,
    FragmentB=pdecon.XComponent,
    FragmentC=Y_2,
    FragmentD=pdecon.YComponent,
    FragmentE=Z_2,
    FragmentF=addition,
    FragmentJ=E,
    FragmentK=ma.PartialResults)

# ----
panel_3 = Panel(multiplication)
panel_4 = Panel(concat)
end_protocol = Panel("""M140 S0
M107
M104 S0 ;extruder heater off
M140 S0 ;heated bed heater off (if you have it)
G91 ;relative positioning
G1 E-1 F300  ;retract the filament a bit before lifting the nozzle, to release some of the pressure
G1 Z+0.5 E-5 X-20 Y-20 F9000 ;move Z up a bit and retract filament even more
G28 X0 Y0 ;move X/Y to min endstops, so the head is out of the way
M84 ;steppers off
G90 ;absolute positioning""")
start_protocol = Panel(""";FLAVOR:Marlin
;TIME:1239
;Filament used: 0.461259m
;Layer height: 0.15
;MINX:52.57
;MINY:56.764
;MINZ:0.27
;MAXX:170.43
;MAXY:166.22
;MAXZ:16.92
;Generated with Cura_SteamEngine 5.2.1
M140 S60
M105
M190 S60
M104 S200
M105
M109 S200
M82 ;absolute extrusion mode
G21 ;metric values
G90 ;absolute positioning
M82 ;set extruder to absolute mode
M106 S255
G28 Z0 ;move Z to bottom endstops
G28 X0 Y0 ;move X/Y to endstops
G1 X15 Y0 F4000 ;move X/Y to front of printer
G1 Z15.0 F9000 ;move the platform to 15mm
G92 E0 ;zero the extruded length
G1 F200 E10 ;extrude 10 mm of feed stock
G92 E0 ;zero the extruded length again
G1 Y50 F9000
;Put printing message on LCD screen
M117 Printing...
G92 E0
G92 E0
G1 F1500 E-6.5""")
merge = Merge(Data1=flatten(start_protocol), Data2=flatten(panel_4), Data3=flatten(end_protocol))
gcode = Panel(merge)

# ==== cluster MoveToCenter
max_y = ClusterInput()
max_x = ClusterInput()
division = Division(MaxY=max_y, B=2)
division_2 = Division(MaxX=max_x, B=2)
X = UnitX(Factor=division_2)
Y = UnitY(Factor=division)
addition = Addition(A=X, B=Y)
G = ClusterInput()
move = Move(Geometry=G, Motion=addition)  # -> Geometry, Transform
G_2 = ClusterOutput(move.Geometry)

# ==== cluster Flow
filament_diameter = ClusterInput()
layer_height = ClusterInput()
line_width = ClusterInput()
multiplier = ClusterInput()
division = Division(FilamentDiameter=filament_diameter, B=2)
multiplication = Multiplication(LayerHeight=layer_height, LineWidth=line_width, Multiplier=multiplier)
sqr = Square(Value=division)
pi = Pi(Factor=sqr)
division_2 = Division(A=multiplication, B=pi)
R = ClusterOutput(division_2)
