# Grasshopper definition Generating_a_Mesh_from_Ear_Canal_Cavity__Simple_.gh (Grasshopper 1.0.7)
# plug-ins: Pufferfish

# ---- group: Creating Mesh Cavity
mesh = Mesh(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)
mshnakededgs = MeshNakedEdges(Mesh=mesh)  # -> Naked, R
pcen = PolygonCenter(Polyline=mshnakededgs.Naked)  # -> CenterV, CenterE, CenterA
item = ListItem(List=pcen.CenterV, Index=Slider(1, range=0..1), Wrap=True)
cyl = Cylinder(Base=item, Radius=Slider(12.7, range=0..100), Length=Slider(20, range=0..100))
msphere = MeshSphere(Base=item, Radius=Slider(20, range=0..100), UCount=10, VCount=20)
mdif = MeshDifference(MeshesA=msphere, MeshesB=mesh)

# ----
preview = CustomPreview(Geometry=mesh, Material=ColourSwatch(SwatchColor=RGBA(173, 173, 173, 154)))

# ---- group: Cleaning contour lines
contour = Contour(Shape=mdif, Point=Point(0, 0, 0), Direction=Vector(0, 0, 1), Distance=Slider(3, range=0.5..10))
clscrv = CloseCurve(Curve=contour, CloseType=0, Bulge=0.5, Tolerance=0)  # -> Closed, R
item_2 = ListItem(List=flatten(clscrv.Closed), Index=Slider(4, range=0..10), Wrap=True)
panel = Panel("""3
4""")
cull_i = CullIndex(List=flatten(clscrv.Closed), Indices=panel, Wrap=True)

# ---- group: Troubleshooting Loft Curves
end = EndPoints(Curve=flatten(cull_i))  # -> Start, End
item_3 = ListItem(List=flatten(end.Start), Index=Slider(2, range=0..10), Wrap=True)
crv_cp = CurveClosestPoint(Point=item_3, Curve=flatten(cull_i))  # -> Point, Parameter, Distance
seam = Seam(Curve=flatten(cull_i), Seam=crv_cp.Parameter)
end_2 = EndPoints(Curve=seam)  # -> Start, End
crv = Curve(seam)
crv_2 = Curve(crv)
item_4 = ListItem(List=crv_2, Index=0, Wrap=True)
flip = FlipCurve(Curve=crv_2, Guide=item_4)  # -> Curve, Flag
crv_3 = Curve(flip.Curve)
crv_4 = Curve(crv_3)
rebcrv = RebuildCurve(Curve=crv_4, Count=Slider(4, range=0..100), Degree=Slider(5, range=0..10), EndTangents=False)
cp = ControlPoints(Curve=rebcrv)  # -> Points, Weights, Knots
loft = Loft(Curves=rebcrv, Options={Adjust=False, Closed=False, LoftEnds=0, LoftSimp=0, LoftType=0, Rebuild=10, Refit=0.01})

# ---- group: Capping holes
srf = Surface(loft)
capex = CapHolesEx(Brep=srf)  # -> Brep, Caps, Solid
brep = Brep(capex.Brep)
filedge = FilletEdge(Shape=brep, Blend=0, Metric=0, Edges=Slider(1, range=0..1), Radii=Slider(0.41, range=0..10))

# ----
preview_2 = CustomPreview(Geometry=filedge, Material=ColourSwatch(SwatchColor=RGB(108, 126, 189)))
