# Grasshopper definition Lesson_4_-_Loft_troubleshooting.gh (Grasshopper 1.0.7)
# plug-ins: Bifocals

# ----
# Troubleshooting Loft
# Order
crv = Curve()
area = Area(Geometry=crv)  # -> Area, Centroid
pdecon = Deconstruct(Point=area.Centroid)  # -> XComponent, YComponent, ZComponent
sort = SortList(Keys=pdecon.ZComponent, ValuesA=crv)  # -> Keys, ValuesA
crv_2 = Curve(sort.ValuesA)

# ----
# Seam alignment
crv_3 = Curve(crv_2)
end = EndPoints(Curve=crv_3)  # -> Start, End
item = ListItem(List=end.Start, Index=0, Wrap=True)
crv_cp = CurveClosestPoint(Point=item, Curve=crv_3)  # -> Point, Parameter, Distance
seam = Seam(Curve=crv_3, Seam=crv_cp.Parameter)
crv_4 = Curve(seam)

# ----
# Direction alignment
crv_5 = Curve(crv_4)
item_2 = ListItem(List=crv_5, Index=0, Wrap=True)
flip = FlipCurve(Curve=crv_5, Guide=item_2)  # -> Curve, Flag
crv_6 = Curve(flip.Curve)

# ----
# Rebuild
crv_7 = Curve(crv_6)
reb = RebuildCurve(Curve=crv_7, Degree=Slider(3, range=1..5), Count=Slider(10, range=0..20), Tangents=False)
crv_8 = Curve(reb)
