# Grasshopper definition Lesson_2_-Wheel.gh (Grasshopper 1.0.7)
# plug-ins: Bifocals

# Spokes - Range list
number_slider = Slider(8, range=0..100)
# Wheel
number_slider_2 = Slider(25, range=0..100)
# Spokes - manual input
number_slider_3 = Slider(0, range=0..1)
yz = YZPlane(Origin=Point(0, 0, 0))
range = Range(Domain=Domain(0, 1), Steps=number_slider)
panel = Panel(range)
deplane = DeconstructPlane(Plane=yz)  # -> Origin, XAxis, YAxis, ZAxis
cir = Circle(Plane=yz, Radius=number_slider_2)
merge = Merge(
    Data1=number_slider_3,
    Data2=Slider(0.14, range=0..1),
    Data3=Slider(0.32, range=0..1),
    Data4=Slider(0.61, range=0..1),
    Data5=Slider(0.76, range=0..1),
    Data6=Slider(0.89, range=0..1))
panel_2 = Panel(merge)
cull_i = CullIndex(List=range, Indices="-1", Wrap="true")
eval = EvaluateCurve(Curve=reparameterize(cir), Parameter=cull_i)  # -> Point, Tangent, Angle
pt = Point(deplane.Origin)
poin = Point(eval.Point)
ln = Line(StartPoint=pt, EndPoint=poin)
pipe = Pipe(Curve=ln, Radius=Slider(0.8, range=0..10), Caps=0)
