# Grasshopper definition Programmable_Textile.gh (Grasshopper 1.0.7)
# plug-ins: Kangaroo2 Components

# ---- group: Round mesh disk
number_slider = Slider(1.5, range=1.5..3)
circle = Circle(Plane=PlaneXY(0, 0, 0), Radius=Slider(18, range=0..100))
settings_custom = SettingsCustom(
    StitchSeams=True,
    SimplePlanes=False,
    Refine=True,
    MinCount=16,
    MaxCount=400,
    AspectRatio=20,
    MaxDistance=0,
    MaxAngle=20,
    MinEdge=number_slider,
    MaxEdge=number_slider)
mesh_brep = MeshBrep(Brep=circle, Settings=settings_custom)
simpleremesh = SimpleRemesh(Geometry=mesh_brep, Length=number_slider, Creases=circle, Steps=50)

# ---- group: Edges
mesh_edges = MeshEdges(Mesh=simpleremesh)  # -> NakedEdges, InteriorEdges, NonManifoldEdges

# ---- group: Obe edge: one vertex small force, one fixed as anchor
list_item = ListItem(List=mesh_edges.NakedEdges, Index=0, Wrap=True)
line = Line(list_item)
panel = Panel(list_item)
end_points = EndPoints(Curve=line)  # -> Start, End
unit_z = UnitZ(Factor=Slider(1e-06, range=0..1e-06))
load = Load(Point=end_points.Start, ForceVector=unit_z, Weighting=1)
anchor = Anchor(Point=end_points.End, Strength=10000)

# ---- group: Rod coinstrain
join_curves = JoinCurves(Curves=mesh_edges.NakedEdges, Preserve=False)
rod = Rod(Polyline=join_curves, LengthFactor=Slider(0.99, range=0..1), AngleFactor=1, AxialStrength=1000, BendStrength=100)

# ----
pt = Point([end_points.Start, end_points.End])

# ---- group: Edge constrain
edgelengths = EdgeLengths(Mesh=simpleremesh, LengthFactor=Slider(0.849, range=0..1), Strength=1)

# ----
show = Show(G=simpleremesh)
merge = Merge(Data1=load, Data2=anchor, Data3=show, Data4=rod, Data5=edgelengths)

# ---- group: Solve & view
solver = Solver(GoalObjects=merge, Reset=Button(), Threshold=1e-15, Tolerance=0.01, On=Toggle(False))  # -> I, V, flatten(O)
panel_2 = Panel(solver.O)
list_item_2 = ListItem(List=solver.O, Index=Slider(0, range=0..1), Wrap=True)
panel_3 = Panel(list_item_2)
mesh = Mesh(list_item_2)

# ----
preview = CustomPreview(Geometry=mesh, Material=ColourSwatch(SwatchColor=RGB(212, 183, 110)))  # disabled
