# Grasshopper definition Personalized_Design_From_3D_Scan_-_Hand_Splint_Exercise.gh (Grasshopper 1.0.7)

mesh = Mesh(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)
get_surface = GetSurface(geometry=mesh)
cluster = Cluster()
surface = Surface(get_surface)
geometry = Geometry(cluster)
construct_domain = ConstructDomain(DomainStart=Slider(0, range=0..1), DomainEnd=Slider(1, range=0..1))
bounding_box = BoundingBox(Content=geometry, Plane=PlaneXY(0, 0, 0))  # -> Box, Box_2
surface_morph = SurfaceMorph(
    Geometry=flatten(geometry),
    Reference=bounding_box.Box,
    Surface=reparameterize(surface),
    UDomain=construct_domain,
    VDomain=construct_domain,
    WDomain=construct_domain)

# ==== cluster GetSurface
geometry = ClusterInput()
geometry_2 = Geometry(geometry)
xy_plane = XYPlane(Origin=Point(0, 0, 0))
bounding_box = BoundingBox(Content=geometry_2, Plane=xy_plane)  # -> Box, Box_2
geometry_3 = Geometry(bounding_box.Box)
deconstruct_box = DeconstructBox(Box=geometry_3)  # -> Plane, X, Y, Z
deconstruct_domain = DeconstructDomain(Domain=deconstruct_box.Z)  # -> Start, End
subtraction = Subtraction(A=deconstruct_domain.Start, B=deconstruct_domain.End)
division = Division(A=subtraction, B=Slider(33, range=1..100))
multiplication = Multiplication(A=division, B=Slider(3, range=1..100))
addition = Addition(A=multiplication, B=deconstruct_domain.End)
number_slider = Slider(100, range=0..100)
series = Series(Start=addition, Step=division, Count=Slider(19, range=1..100))
plane_offset = PlaneOffset(BasePlane=deconstruct_box.Plane, Offset=series)
unit_x = UnitX(Factor=Slider(-75, range=-100..100))
plane_surface = PlaneSurface(Plane=plane_offset, XSize=number_slider, YSize=number_slider)
mesh_plane = MeshPlane(Mesh=geometry_2, Plane=plane_offset)
move = Move(Geometry=plane_surface, Motion=unit_x)  # -> Geometry, Transform
unit_y = UnitY(Factor=Slider(-75, range=-100..100))
move_2 = Move(Geometry=move.Geometry, Motion=unit_y)  # -> Geometry, Transform
rebuild_curve = RebuildCurve(Curve=mesh_plane, Degree=Slider(3, range=0..10), Count=Slider(20, range=0..100), Tangents=False)
loft_options = LoftOptions(Closed=Toggle(False), Adjust=Toggle(True), Rebuild=0, Refit=0, Type=Slider(2, range=0..5))
loft = Loft(Curves=flatten(rebuild_curve), Options=loft_options)
loft_2 = ClusterOutput(loft)

# ==== cluster Cluster
number_slider = Slider(100, range=0..100)
xy_plane = XYPlane(Origin=Point(0, 0, 0))
multiplication = Multiplication(A=number_slider, B=Slider(3, range=1..5))
rectangle = Rectangle(Plane=xy_plane, XSize=multiplication, YSize=number_slider, Radius=0)  # -> Rectangle, Length
offset_curve = OffsetCurve(Curve=rectangle.Rectangle, Distance=Slider(-19, range=-50..0), Corners=1)
populate_2d = Populate2D(Region=offset_curve, Count=Slider(31, range=0..100), Seed=1)
geometry = Geometry(rectangle.Rectangle)
voronoi = Voronoi(Points=populate_2d, Boundary=geometry, BruteForceOverride=False)
offset_curve_2 = OffsetCurve(Curve=flatten(voronoi), Distance=Slider(-4, range=-50..0), Corners=Slider(2, range=0..5))
merge = Merge(Data1=flatten(rectangle.Rectangle), Data2=flatten(offset_curve_2))
boundary_surfaces = BoundarySurfaces(Edges=merge)
unit_z = UnitZ(Factor=Slider(2.9, range=1..10))
extrude = Extrude(Base=boundary_surfaces, Direction=unit_z)
extrusion = ClusterOutput(extrude)
