# Grasshopper definition Generative_Grow_on_Vase.gh (Grasshopper 1.0.7)
# plug-ins: Kangaroo2 Components

# ---- group: Starting point
xy_plane = XYPlane(Origin=Point(0, 0, 0))
circle = Circle(Plane=xy_plane, Radius=Slider(7, range=0..10))

# ---- group: Segments
# divide the curve to many pieces
number_slider = Slider(2161, range=0..10000)
divide_curve = DivideCurve(Curve=circle, Count=number_slider, Kinks=False)  # -> Points, Tangents, Parameters
polyline = PolyLine(Vertices=divide_curve.Points, Closed=Toggle(True))
explode = Explode(Curve=polyline, Recursive=True)  # -> Segments, Vertices

# ---- group: 3D vase shape
gene_pool = GenePool(Decimals=2, Maximum=100, Minimum=0, Value=[0, 17.94, 40.31, 62.68, 85.79])
gene_pool_2 = GenePool(Decimals=2, Maximum=100, Minimum=0, Value=[25.39, 11.97, 33.6, 50, 80.57])
construct_point = ConstructPoint(XCoordinate=0, YCoordinate=0, ZCoordinate=gene_pool)
xy_plane_2 = XYPlane(Origin=construct_point)
circle_2 = Circle(Plane=xy_plane_2, Radius=gene_pool_2)
loft_options = LoftOptions(Closed=False, Adjust=False, Rebuild=0, Refit=Toggle(True), Type=Slider(1, range=0..1))
number_slider_2 = Slider(44, range=5..100)
loft = Loft(Curves=circle_2, Options=loft_options)
mesh_surface = MeshSurface(Surface=loft, UCount=number_slider_2, VCount=number_slider_2, Overhang=True, Equalize=False)

# ----
point = Point(divide_curve.Points)

# ---- group: Length
length = Length(Curve=explode.Segments)
# drag me from 1
#  slowly towards large numbers
number_slider_3 = Slider(90, range=1..200)
average = Average(Input=length)
multiplication = Multiplication(A=average, B=number_slider_3)
length_line = LengthLine(Line=explode.Segments, Length=multiplication, Strength=Slider(28, range=0..100))

# ---- group: Design space
onmesh = OnMesh(Points=point, Mesh=mesh_surface, Strength=Slider(100, range=0..100))

# ---- group: Sphere constrain
division = Division(A=multiplication, B=Slider(0.6, range=0.1..5))
spherecollide = SphereCollide(Points=point, Radius=division, Strength=Slider(63, range=1..100))

# ----
show = Show(G=explode.Segments)

# ---- group: Solver
merge = Merge(Data1=show, Data2=length_line, Data3=spherecollide, Data4=onmesh)
bouncysolver = BouncySolver(
    GoalObjects=merge,
    Reset=Button(),
    Threshold=Slider(0.01, range=0..0.01),
    Tolerance=0.01,
    Damping=Slider(0.95, range=0..1),
    Iterations=Slider(50, range=0..100),
    On=Toggle(False))  # -> I, V, O

# ---- group: Closed polyline
polyline_2 = PolyLine(Vertices=bouncysolver.V, Closed=Toggle(False))

# ----
panel = Panel(bouncysolver.I)

# ---- group: Building Final Geometry
rebuild_curve = RebuildCurve(Curve=polyline_2, Degree=Slider(3, range=0..10), Count=Slider(1000, range=0..1000), Tangents=False)
pipe = Pipe(Curve=rebuild_curve, Radius=1, Caps=0)
preview = CustomPreview(Geometry=[mesh_surface, pipe], Material=ColourSwatch(SwatchColor=RGB(195, 219, 154)))
