# Grasshopper definition Lesson_2_-_Train_tutorial.gh (Grasshopper 1.0.7)
# plug-ins: Bifocals

# ----
# Mountain
number_slider = Slider(3, range=0..5)
mountain_height = Slider(37, range=0..100)
pt = Point([Point(-13.12241153, -10, 0), Point(-25.12913179, -5, 0), Point(-26.97631952, 20, 0), Point(18.27977992, 39, 0), Point(49.68197137, 4, 0), Point(39.52243884, -19, 0), Point(7.807902595, -35, 0), Point(0.7314964612, -6, 0)])
nurbs = NurbsCurve(Vertices=pt, Degree=number_slider, Periodic=Toggle(True))  # -> Curve, Length, Domain
avr = Average(Input=pt)
Z = UnitZ(Factor=mountain_height)
move = Move(Geometry=avr, Motion=Z)  # -> Geometry, Transform
extr = ExtrudePoint(Base=nurbs.Curve, Point=move.Geometry)
cap = CapHoles(Brep=extr)
preview = CustomPreview(Geometry=cap, Material=ColourSwatch(SwatchColor=RGB(53, 105, 66)))

# ----
# Train track
# Center of track
number_slider_2 = Slider(2.5, range=0..5)
track_width = Slider(1.2, range=0..5)
crv = Curve(nurbs.Curve)
offset_l = OffsetCurveLoose(Curve=crv, Distance=number_slider_2)
neg = Negative(Value=track_width)
merge = Merge(Data1=track_width, Data2=neg)
offset_l_2 = OffsetCurveLoose(Curve=offset_l, Distance=merge)
boundary = BoundarySurfaces(Edges=offset_l_2)
preview_2 = CustomPreview(Geometry=boundary, Material=ColourSwatch(SwatchColor=RGB(112, 108, 108)))

# ----
# Train
number_slider_3 = Slider(2.8, range=0..5)
number_slider_4 = Slider(1.3, range=0..5)
box = CenterBox(Base=PlaneXY(0, 0, 0), X=number_slider_3, Y=Slider(1.5, range=0..5), Z=number_slider_4)

# ----
# Train on track
number_slider_5 = Slider(1, range=0..1)
crv_2 = Curve(reparameterize(offset_l))
neg_2 = Negative(Value=number_slider_4)
Z_2 = UnitZ(Factor=neg_2)
xy = XYPlane(Origin=Point(0, 0, 0))
eval = EvaluateCurve(Curve=crv_2, Parameter=number_slider_5)  # -> Point, Tangent, Angle
move_2 = Move(Geometry=xy, Motion=Z_2)  # -> Geometry, Transform
xy_2 = XYPlane(Origin=eval.Point)
align = AlignPlane(Plane=xy_2, Direction=eval.Tangent)  # -> Plane, Angle
orient = Orient(Geometry=box, Source=move_2.Geometry, Target=align.Plane)  # -> Geometry, Transform
preview_3 = CustomPreview(Geometry=orient.Geometry, Material=ColourSwatch(SwatchColor=RGB(16, 125, 227)))
