# Grasshopper definition Lesson_3_-_Brick_wall.gh (Grasshopper 1.0.7)
# plug-ins: Bifocals

# ----
# Grid setup
number_slider = Slider(7.4, range=0..10)
size_z = Slider(3.8, range=0..10)
extent_z = Slider(9, range=0..10)
xz = XZPlane(Origin=Point(0, 0, 0))
recgrid = Rectangular(Plane=xz, SizeX=number_slider, SizeY=size_z, ExtentX=Slider(7, range=0..10), ExtentY=extent_z)  # -> Cells, Points

# ----
# Move bricks
panel = Panel("""0
0.5""")
repeat = RepeatData(Data=panel, Length=extent_z)
multiplication = Multiplication(A=number_slider, B=repeat)
X = UnitX(Factor=multiplication)
move = Move(Geometry=recgrid.Cells, Motion=X)  # -> flatten(Geometry), Transform

# ----
# Number preview
pcen = PolygonCenter(Polyline=move.Geometry)  # -> CenterV, CenterE, CenterA
points = PointList(Points=pcen.CenterV, Size=Slider(2, range=0..5))

# ----
# Spacing
number_slider_2 = Slider(-0.3, range=-1..1)
offset = OffsetCurve(Curve=move.Geometry, Distance=number_slider_2, Corners=1)  # -> flatten(Curve)
fillet = Fillet(Curve=offset, Radius=Slider(0.9, range=0..5))

# ----
# Create solid shapes
thickness = Slider(3.2, range=0..10)
Y = UnitY(Factor=thickness)
extr = Extrude(Base=fillet, Direction=Y)
cap = CapHoles(Brep=extr)

# ----
# Attractor point
pt = Point(Point(28.47492339, -22.94946545, 14.88945166))

# ----
# Centre points
pt_2 = Point(pcen.CenterV)
number_slider_3 = Slider(1, range=0..20)
number_slider_4 = Slider(5, range=0..20)
dist = Distance(PointA=pt, PointB=pt_2)
bnd = Bounds(Numbers=dist)
dom = ConstructDomain(DomainStart=number_slider_3, DomainEnd=number_slider_4)
remap = RemapNumbers(Value=dist, Source=bnd, Target=dom)  # -> Mapped, Clipped
neg = Negative(Value=remap.Mapped)
scale_nu = ScaleNU(Geometry=cap, Plane=PlaneXY(0, 0, 0), ScaleX=1, ScaleY=neg, ScaleZ=1)  # -> Geometry, Transform

gradient = Gradient(
    LowerLimit=number_slider_3,
    UpperLimit=number_slider_4,
    Parameter=remap.Mapped,
    stops=[0: RGB(234, 38, 0), 0.25: RGB(234, 126, 0), 0.5: RGB(254, 244, 84), 0.75: RGB(173, 203, 249), 1: RGB(75, 107, 169)])
preview = CustomPreview(Geometry=scale_nu.Geometry, Material=gradient)
