# Grasshopper definition Generative_Tent.gh (Grasshopper 1.0.7)
# plug-ins: Kangaroo2 Components

# ---- group: Mesh
number_slider = Slider(64.3, range=0..100)
plane_surface = PlaneSurface(Plane=PlaneXY(0, 0, 0), XSize=number_slider, YSize=number_slider)
number_slider_2 = Slider(50, range=0..100)
mesh_surface = MeshSurface(Surface=plane_surface, UCount=number_slider_2, VCount=number_slider_2, Overhang=True, Equalize=False)

# ---- group: Anchor Points
gene_pool = GenePool(Decimals=2, Maximum=100, Minimum=0, Value=[30.15, 36.52, 37.68, 51.01])
unit_z = UnitZ(Factor=gene_pool)
deconstruct_brep = DeconstructBrep(Brep=plane_surface)  # -> Faces, Edges, Vertices
addition = Addition(A=deconstruct_brep.Vertices, B=unit_z)
point = Point(deconstruct_brep.Vertices)

# ---- group: Constrain
edgelengths = EdgeLengths(Mesh=mesh_surface, LengthFactor=Slider(0.6, range=0..1), Strength=1)
anchor = Anchor(Point=point, Target=addition, Strength=10000)
show = Show(G=mesh_surface)

# ---- group: Kangaroo Solver
merge = Merge(Data1=show, Data2=anchor, Data3=edgelengths)
solver = Solver(GoalObjects=flatten(merge), Reset=Button(), Threshold=1e-15, Tolerance=0.01, On=Toggle(False))  # -> I, V, O
panel = Panel(solver.O)
list_item = ListItem(List=solver.O, Index=0, Wrap=True)
panel_2 = Panel(solver.I)
mesh = Mesh(list_item)
preview = CustomPreview(Geometry=mesh, Material=ColourSwatch(SwatchColor=RGB(148, 179, 212)))  # disabled
