# Grasshopper definition Shape_Changing_Textile.gh (Grasshopper 1.0.7)
# plug-ins: Kangaroo2 Components

# ---- group: Round mesh disk
number_slider = Slider(18, range=0..100)
number_slider_2 = Slider(1.5, range=1.5..3)
circle = Circle(Plane=PlaneXY(0, 0, 0), Radius=number_slider)
settings_custom = SettingsCustom(
    StitchSeams=True,
    SimplePlanes=False,
    Refine=True,
    MinCount=16,
    MaxCount=400,
    AspectRatio=20,
    MaxDistance=0,
    MaxAngle=20,
    MinEdge=number_slider_2,
    MaxEdge=number_slider_2)
mesh_brep = MeshBrep(Brep=circle, Settings=settings_custom)
simpleremesh = SimpleRemesh(Geometry=mesh_brep, Length=number_slider_2, Creases=circle, Steps=50)

# ---- group: Edges
mesh_edges = MeshEdges(Mesh=simpleremesh)  # -> NakedEdges, InteriorEdges, NonManifoldEdges

# ---- group: 3D Print Render Preview
xz = XZPlane(Origin=Point(0, 0, 0))
rectangle = Rectangle(Plane=xz, XSize=Domain(-0.3, 0.3), YSize=Domain(-0.3, 0.3), Radius=0)  # -> Rectangle, Length
X = UnitX(Factor=number_slider)
move = Move(Geometry=rectangle.Rectangle, Motion=X)  # -> Geometry, Transform
swp1 = Sweep1(Rail=circle, Sections=move.Geometry, Miter=1)
srf = Surface(circle)
preview = CustomPreview(Geometry=srf, Material=ColourSwatch(SwatchColor=RGB(212, 183, 110)))  # disabled
preview_2 = CustomPreview(Geometry=[srf, swp1], Material=ColourSwatch(SwatchColor=RGB(174, 232, 229)))  # disabled

# ---- group: One edge: one vertex small force, one fixed as anchor
list_item = ListItem(List=mesh_edges.NakedEdges, Index=0, Wrap=True)
line = Line(list_item)
end_points = EndPoints(Curve=line)  # -> Start, End
panel = Panel(list_item)
unit_z = UnitZ(Factor=Slider(1e-06, range=0..1e-06))
load = Load(Point=end_points.Start, ForceVector=unit_z, Weighting=1)
anchor = Anchor(Point=end_points.End, Strength=10000)

# ---- group: Rod coinstrain
join_curves = JoinCurves(Curves=mesh_edges.NakedEdges, Preserve=False)
rod = Rod(Polyline=join_curves, LengthFactor=Slider(0.99, range=0..1), AngleFactor=1, AxialStrength=1000, BendStrength=100)

# ----
pt = Point([end_points.Start, end_points.End])

# ---- group: Edge constrain
edgelengths = EdgeLengths(Mesh=simpleremesh, LengthFactor=Slider(0.849, range=0..1), Strength=1)

# ----
show = Show(G=simpleremesh)
merge = Merge(Data1=load, Data2=anchor, Data3=show, Data4=rod, Data5=edgelengths)

# ---- group: Solve & view
solver = Solver(GoalObjects=merge, Reset=Button(), Threshold=1e-15, Tolerance=0.01, On=Toggle(False))  # -> I, V, flatten(O)
panel_2 = Panel(solver.O)
list_item_2 = ListItem(List=solver.O, Index=Slider(0, range=0..1), Wrap=True)
panel_3 = Panel(list_item_2)
mesh = Mesh(list_item_2)

# ----
preview_3 = CustomPreview(Geometry=mesh, Material=ColourSwatch(SwatchColor=RGB(212, 183, 110)))
