# Grasshopper definition TESTINGData-Driven Design_ShoeSole New test.gh (Grasshopper 1.0.7)
# plug-ins: LunchBox, Pufferfish, Kangaroo2 Components, Bifocals

# Right-click and select
# file containing data
path = FilePath("C:\Users\Jose\Github\grasshopper-open-access-test\grasshopper files development\Data-driven design\FootPressure_Data.csv")

# ----
# Read data and create a data tree
file = ReadFile(File=path, PerLineParse=True)
csv = ReadCSV(CSVString=file, Delimiter=";")  # -> Headers, Values
panel = Panel(csv.Values)

# ----
# Set up the rectangular grid representing
# the subdivision of the data points
lng = ListLength(List=csv.Values)
item = ListItem(List=flatten(lng), Index=0, Wrap=True)
lng_2 = ListLength(List=flatten(lng))
subtraction = Subtraction(A=item, B="1")
subtraction_2 = Subtraction(A=lng_2, B="1")
recgrid = Rectangular(Plane=PlaneXY(0, 0, 0), SizeX=2, SizeY=Slider(2.5, range=0..10), ExtentX=subtraction_2, ExtentY=subtraction)  # -> Cells, simplify(Points)
neg = Negative(Value=subtraction)
neg_2 = Negative(Value=subtraction_2)
vec = VectorXYZ(XComponent=neg_2, YComponent=neg, ZComponent=0)  # -> Vector, Length
move = Move(Geometry=recgrid.Points, Motion=vec.Vector)  # -> Geometry, Transform
move_2 = Move(Geometry=recgrid.Cells, Motion=vec.Vector)  # -> Geometry, Transform

# ----
# Normalize data and map values to depth
# Maximal depth
bnd = Bounds(Numbers=flatten(csv.Values))
remap = RemapNumbers(Value=csv.Values, Source=bnd, Target=Domain(0, 1))  # -> Mapped, Clipped
graph = GraphMapper(remap.Mapped, x0=0, x1=1, y0=0, y1=1, Gx=0.9909009933, Gy=0.8721039295, Ox=0, Oy=0, container_name="Square Root")
multiplication = Multiplication(A=graph, B=Slider(-4, range=-10..0.5))

srf = Surface(move_2.Geometry)

# ----
# Add depth to the surface based on pressure data
pdecon = Deconstruct(Point=move.Geometry)  # -> XComponent, YComponent, ZComponent
addition = Addition(A=pdecon.ZComponent, B=multiplication)
pt = ConstructPoint(XCoordinate=pdecon.XComponent, YCoordinate=pdecon.YComponent, ZCoordinate=addition)
lastdex = LastIndex(List=pt)
lng_3 = ListLength(List=flatten(lastdex))
srfgrid = SurfaceFromPoints(Points=flatten(pt), UCount=lng_3, Interpolate=False)

# ----
# Visualize data
gradient = Gradient(
    LowerLimit=0,
    UpperLimit=1,
    Parameter=remap.Mapped,
    stops=[0: RGB(35, 28, 129), 0.155: RGB(46, 239, 59), 0.306: RGB(0, 255, 0), 0.497: RGB(255, 255, 0), 0.805: RGB(220, 0, 40)])
tag = TextTag(Location=move.Geometry, Text=csv.Values)
preview = CustomPreview(Geometry=srf, Material=gradient)

# ----
# Create shape of foot sole based
# on the pressure data and split surface
panel_2 = Panel("0")
mindex = MemberIndex(Set=csv.Values, Member=panel_2)  # -> Index, Count
cull_i = CullIndex(List=pt, Indices=mindex.Index, Wrap=True)
hull = ConvexHull(Points=flatten(cull_i), Plane=PlaneXY(0, 0, 0))  # -> Hull, HullZ, Indices
reb = RebuildCurve(Curve=hull.Hull, Degree=Slider(20, range=0..100), Count=10, Tangents=False)
offset = OffsetCurve(Curve=reb, Distance=Slider(-2.048, range=-10..0), Corners=1)
srfsplit = SurfaceSplit(Surface=srfgrid, Curves=offset)
item_2 = ListItem(List=srfsplit, Index=0, Wrap=True)

srfgrid_2 = SurfaceFromPoints(Points=flatten(move.Geometry), UCount=lng_3, Interpolate=False)
srfsplit_2 = SurfaceSplit(Surface=srfgrid_2, Curves=offset)
item_3 = ListItem(List=srfsplit_2, Index=0, Wrap=True)

# ----
# Increase the boundary size of the cutting plane
offset_2 = OffsetCurve(Curve=srfgrid, Distance=1, Corners=1)
loft = Loft(
    Curves=flatten([srfgrid, offset_2]),
    Options={Adjust=False, Closed=False, LoftEnds=0, LoftSimp=0, LoftType=0, Rebuild=10, Refit=0.01})
join = BrepJoin(Breps=[loft, srfgrid])  # -> Breps, Closed

# ----
# Loft the surface
number_slider = Slider(-4, range=-10..-2)
pt_2 = ConstructPoint(XCoordinate=0, YCoordinate=0, ZCoordinate=number_slider)
xy = XYPlane(Origin=pt_2)
project = Project(Geometry=item_2, Plane=xy)  # -> Geometry, Transform
loft_2 = Loft(
    Curves=[item_2, project.Geometry],
    Options={Adjust=False, Closed=False, LoftEnds=0, LoftSimp=0, LoftType=0, Rebuild=10, Refit=0.01})
material = CreateMaterial(
    Diffuse=ColourSwatch(SwatchColor=RGB(222, 222, 222)),
    Specular=RGB(255, 254, 254),
    Emission=RGB(0, 0, 0),
    Transparency=0,
    Shine=0)
merge = Merge(Data1=item_2, Data2=loft_2, Data3=project.Geometry)
join_2 = BrepJoin(Breps=merge)  # -> Breps, Closed
preview_2 = CustomPreview(Geometry=join_2.Breps, Material=material)  # disabled

graph_2 = GraphMapper(
    graph,
    x0=0,
    x1=1,
    y0=0.7,
    y1=0.4,
    A=1,
    B=0,
    container_name="Linear",
    Graph_x0=0.25,
    Graph_x1=0.75,
    Graph_y0=0.25,
    Graph_y1=0.75)
neg_3 = Negative(Value=graph_2)
dom = ConstructDomain(DomainStart=neg_3, DomainEnd=graph_2)
number_slider_2 = Slider(0.7, range=0..1)
rectangle = Rectangle(Plane=move.Geometry, XSize=dom, YSize=dom, Radius=Slider(0.15, range=0.001..1))  # -> Rectangle, Length
project_2 = Project(Curve=rectangle.Rectangle, Brep=item_3, Direction=Vector(0, 0, 1))
boundary = BoundarySurfaces(Edges=flatten([project_2, offset]))
Z = UnitZ(Factor=Slider(4, range=0..10))
move_3 = Move(Geometry=join.Breps, Motion=Z)  # -> Geometry, Transform
Z_2 = UnitZ(Factor=Slider(5, range=0..10))
edges = BrepEdges(Brep=boundary)  # -> Naked, Interior, NonManifold
extr = Extrude(Base=boundary, Direction=Z_2)
extr_2 = Extrude(Base=move_3.Geometry, Direction=Z_2)
sdiff = SolidDifference(BrepsA=extr, BrepsB=extr_2)

# ----
# Generate grid cell pattern from pressure data
graph_3 = GraphMapper(
    graph,
    x0=0,
    x1=1,
    y0=1,
    y1=3,
    A=1,
    B=0,
    container_name="Linear",
    Graph_x0=0.25,
    Graph_x1=0.75,
    Graph_y0=0.25,
    Graph_y1=0.75)
grid = GridStructure(Surface=reparameterize(srf), UDivisions=graph_3, VDivisions=graph_3)  # -> StructureLines, StructureNodes
project_3 = Project(Curve=grid.StructureLines, Brep=item_2, Direction=Vector(0, 0, 1))  # disabled
trim = TrimTree(Tree=project_3, Depth=1)
mp = MultiPipe(Curves=trim, NodeSize=Slider(0.5, range=0..1), EndOffset=1, StrutSize=1, Segment=0, KinkAngle=0.6, CubeFit=0, Caps=1)
pipe = Pipe(Curve=offset, Radius=1, Caps=0)
material_2 = CreateMaterial(
    Diffuse=ColourSwatch(SwatchColor=RGB(196, 196, 196)),
    Specular=RGB(255, 254, 254),
    Emission=RGB(0, 0, 0),
    Transparency=0,
    Shine=0)
preview_3 = CustomPreview(Geometry=sdiff, Material=material_2)

quad_panels = QuadPanels(Surface=srf, UDivisions=graph_3, VDivisions=graph_3)
negative = Negative(Value=Slider(0.2, range=0..1))
curve = Curve(quad_panels)
explode = Explode(Curve=grid.StructureLines, Recursive=True)  # -> Segments, Vertices
offset_curve = OffsetCurve(Curve=curve, Distance=negative, Corners=1)  # disabled
bounding_rectangle = BoundingRectangle(Geometry=flatten(offset_curve), Plane=PlaneXY(0, 0, 0), Axis=0, Slide=0, Union=True)  # -> Bounding, DimensionX, DimensionY
offset_curve_2 = OffsetCurve(Curve=bounding_rectangle.Bounding, Distance=1, Corners=1)
curve_2 = Curve(offset_curve_2)
boundary_surfaces = BoundarySurfaces(Edges=flatten([curve_2, offset_curve]))
list_item = ListItem(List=boundary_surfaces, Index=Slider(0, range=0..100), Wrap=True)
surface = Surface(list_item)
unit_z = UnitZ(Factor=Slider(-7, range=-10..0))
negative_2 = Negative(Value=unit_z)
move_4 = Move(Geometry=surface, Motion=unit_z)  # -> Geometry, Transform
surface_2 = Surface(item_2)
extrude = Extrude(Base=surface_2, Direction=unit_z)
extrude_2 = Extrude(Base=move_4.Geometry, Direction=negative_2)
