# Grasshopper definition 07.02.kangraoo_Tent_3d.gh (Grasshopper 1.0.7)
# plug-ins: Kangaroo2 Components

# ---- group: Mesh
number_slider = Slider(64.3, range=0..100)
plane_surface = PlaneSurface(Plane=PlaneXY(0, 0, 0), XSize=number_slider, YSize=number_slider)
number_slider_2 = Slider(50, range=0..100)
mesh_surface = MeshSurface(Surface=plane_surface, UCount=number_slider_2, VCount=number_slider_2, Overhang=True, Equalize=False)

# ---- group: Anchor
gene_pool = GenePool(Decimals=2, Maximum=100, Minimum=0, Value=[30.15, 36.52, 37.68, 51.01])
unit_z = UnitZ(Factor=gene_pool)
deconstruct_brep = DeconstructBrep(Brep=plane_surface)  # -> Faces, Edges, Vertices
point = Point(deconstruct_brep.Vertices)
addition = Addition(A=deconstruct_brep.Vertices, B=unit_z)

# ----
srf = Surface(plane_surface)
point_2 = Point(addition)

# ---- group: Constrain
edgelengths = EdgeLengths(Mesh=mesh_surface, LengthFactor=Slider(0.6, range=0..1), Strength=1)
anchor = Anchor(Point=point, Target=addition, Strength=10000)
show = Show(G=mesh_surface)

# ----
merge = Merge(Data1=show, Data2=anchor, Data3=edgelengths)
panel = Panel(merge)
solver = Solver(GoalObjects=flatten(merge), Reset=Button(), Threshold=1e-15, Tolerance=0.01, On=True)  # -> I, V, O
panel_2 = Panel(solver.O)
panel_3 = Panel(solver.I)
list_item = ListItem(List=solver.O, Index=0, Wrap=True)
mesh = Mesh(list_item)
preview = CustomPreview(Geometry=mesh, Material=ColourSwatch(SwatchColor=RGB(148, 179, 212)))
