# Grasshopper definition 07.04.kangraoo_grow_in_3d.gh (Grasshopper 1.0.7)
# plug-ins: Kangaroo2 Components

# ---- group: Starting point
xy_plane = XYPlane(Origin=Point(0, 0, 0))
circle = Circle(Plane=xy_plane, Radius=Slider(7, range=0..10))

# ----
# we cut the circle too a lot of small pieces
number_slider = Slider(1776, range=10..2000)

# ---- group: CReate segment
divide_curve = DivideCurve(Curve=circle, Count=number_slider, Kinks=False)  # -> Points, Tangents, Parameters
polyline = PolyLine(Vertices=divide_curve.Points, Closed=Toggle(True))
# drag me from 0.1 slowly towards large numbers
explode = Explode(Curve=polyline, Recursive=True)  # -> Segments, Vertices

# ----
point = Point(divide_curve.Points)

# ---- group: Boundary constrain
number_slider_2 = Slider(36.2, range=0..1000)
xy_plane_2 = XYPlane(Origin=Point(0, 0, 0))
division = Division(A=number_slider_2, B=Slider(-2, range=-10..0))
rectangle = Rectangle(Plane=xy_plane_2, XSize=number_slider_2, YSize=number_slider_2, Radius=0)  # -> Rectangle, Length
vector_xyz = VectorXYZ(XComponent=division, YComponent=division, ZComponent=0)  # -> Vector, Length
move = Move(Geometry=rectangle.Rectangle, Motion=vector_xyz.Vector)  # -> Geometry, Transform
onmesh = OnMesh(Points=point, Mesh=move.Geometry, Strength=1)

# ---- group: Edge length constrain
length = Length(Curve=explode.Segments)
average = Average(Input=length)
multiplication = Multiplication(A=average, B=Slider(0.1, range=0.1..100))
length_line = LengthLine(Line=explode.Segments, Length=multiplication, Strength=10)

# ---- group: Distance constrain
division_2 = Division(A=multiplication, B=Slider(0.1, range=0.1..5))
spherecollide = SphereCollide(Points=point, Radius=division_2, Strength=1)

# ----
show = Show(G=explode.Segments)

# ---- group: Optimize
merge = Merge(Data1=show, Data2=length_line, Data3=spherecollide, Data4=onmesh)
solver = Solver(GoalObjects=flatten(merge), Reset=Button(), Threshold=1e-15, Tolerance=0.01, On=Toggle(True))  # -> I, V, O

# ---- group: Closed polyline
polyline_2 = PolyLine(Vertices=solver.V, Closed=Toggle(True))

# ----
panel = Panel(solver.I)
