# Grasshopper definition 07.04.kangraoo_grow_in_arm.gh (Grasshopper 1.0.7)
# plug-ins: Kangaroo2 Components

# ---- group: Curve on mesh
yz_plane = YZPlane(Origin=Point(0, 0, 0))
mesh = Mesh(<mesh referenced from the Rhino model>)
mesh_plane = MeshPlane(Mesh=mesh, Plane=yz_plane)
fit_curve = FitCurve(Curve=mesh_plane, Degree=Slider(3, range=0..10))
curve = Curve(fit_curve)

# ---- group: Segments
divide_curve = DivideCurve(Curve=curve, Count=Slider(3378, range=0..10000), Kinks=False)  # -> Points, Tangents, Parameters
polyline = PolyLine(Vertices=divide_curve.Points, Closed=Toggle(True))
explode = Explode(Curve=polyline, Recursive=True)  # -> Segments, Vertices

# ----
point = Point(divide_curve.Points)
mesh_2 = Mesh(mesh)
# drag me from 1
#  slowly towards large numbers
number_slider = Slider(32, range=0.1..100)

# ---- group: Length
length = Length(Curve=explode.Segments)
average = Average(Input=length)
multiplication = Multiplication(A=average, B=number_slider)
length_line = LengthLine(Line=explode.Segments, Length=multiplication, Strength=Slider(64, range=0..100))

# ---- group: Design space
onmesh = OnMesh(Points=point, Mesh=mesh_2, Strength=Slider(100, range=0..100))

# ---- group: Sphere constrain
division = Division(A=multiplication, B=Slider(0.6, range=0.1..5))
spherecollide = SphereCollide(Points=point, Radius=division, Strength=Slider(51, range=1..100))

# ----
show = Show(G=explode.Segments)

# ---- group: Solver
merge = Merge(Data1=show, Data2=length_line, Data3=spherecollide, Data4=onmesh)
bouncysolver = BouncySolver(
    GoalObjects=merge,
    Reset=Button(),
    Threshold=Slider(0.0001, range=0.0001..0.001),
    Tolerance=Slider(0.0001, range=0.0001..0.001),
    Damping=Slider(0.98, range=0..1),
    Iterations=10,
    On=Toggle(True))  # -> I, V, O

# ----
panel = Panel(bouncysolver.I)

# ---- group: Closed polyline
polyline_2 = PolyLine(Vertices=bouncysolver.V, Closed=Toggle(False))

# ----
panel_2 = Panel(bouncysolver.V)
rebuild_curve = RebuildCurve(Curve=polyline_2, Degree=Slider(3, range=0..10), Count=Slider(1000, range=0..1000), Tangents=False)
