# Grasshopper definition 07.05.Bouncing_ball.gh (Grasshopper 1.0.7)
# plug-ins: Kangaroo2 Components

# ---- group: Floor
surface = Surface(<surface referenced from the Rhino model>)
offset_surface = OffsetSurface(Surface=surface, Distance=Slider(1.5, range=0..10), Retrim=True)
loft = Loft(
    Curves=[offset_surface, surface],
    Options={Adjust=False, Closed=False, LoftEnds=0, LoftSimp=0, LoftType=0, Rebuild=10, Refit=0.01})
brep_join = BrepJoin(Breps=[surface, offset_surface, loft])  # -> Breps, Closed
mesh_brep = MeshBrep(
    Brep=brep_join.Breps,
    Settings={GridMaxCount=0, GridMinCount=16, JaggedSeams=False, MaxEdgeLength=0, MinEdgeLength=0.0001, MinTolerance=0, Refine=True, RefineAngle=0, RelativeTolerance=0.65, SimplePlanes=True, Tolerance=0})

# ---- group: Balls
number_slider = Slider(-15.882, range=-100..0)
number_slider_2 = Slider(14, range=0..100)
construct_point = ConstructPoint(XCoordinate=number_slider, YCoordinate=number_slider, ZCoordinate=Slider(9, range=0..10))
construct_point_2 = ConstructPoint(XCoordinate=number_slider_2, YCoordinate=number_slider_2, ZCoordinate=Slider(38, range=0..100))
box_2pt = Box2Pt(PointA=construct_point, PointB=construct_point_2, Plane=PlaneXY(0, 0, 0))
populate_geometry = PopulateGeometry(Geometry=box_2pt, Count=Slider(88, range=0..100), Seed=1)

# ---- group: BOundary conditions
number_slider_3 = Slider(2.3, range=0..3)
unit_z = UnitZ(Factor=Slider(-0.028, range=-1..0))
load = Load(Point=populate_geometry, ForceVector=unit_z, Weighting=1)
solidpointcollide = SolidPointCollide(Points=populate_geometry, Solid=mesh_brep, Interior=False, Unidirectional=True, Strength=Slider(5, range=0.5..5))
spherecollide = SphereCollide(Points=populate_geometry, Radius=number_slider_3, Strength=1)
show = Show(G=populate_geometry)

# ---- group: Solvers
merge = Merge(Data1=spherecollide, Data2=load, Data3=show, Data4=solidpointcollide)
bouncysolver = BouncySolver(
    GoalObjects=merge,
    Reset=Button(),
    Threshold=1e-15,
    Tolerance=0.01,
    Damping=Slider(0.98, range=0..1),
    Iterations=10,
    On=True)  # -> I, V, O

# ---- group: Display
mesh_sphere = MeshSphere(Base=bouncysolver.O, Radius=number_slider_3, UCount=10, VCount=20)
