# Grasshopper definition 08.02.Data_driven_foot_lattice_method_2.gh (Grasshopper 1.0.7)
# Copyright: ©2019 GNU General Public License

# ---- group: Input data
ghpython_script = GhPythonScript(filename="D:\\footPressure.csv")  # -> out, val
# ---------- ghpython_script: Python ----------
__author__ = "Yu Song"
__version__ = "2020.05.02"

import rhinoscriptsyntax as rs
import sys
#check inputs
print(filename)

#open file
f = open(filename,"r")

#empty list
text = []

#read file line by line
if f.mode == 'r':
    #read a line
    f1 = f.readlines()
    for x in f1:
        print (x)
        #remove "\n" i.e. return in the graph
        temp = x.rstrip()
        print (temp)
        #split text by comma "," 
        line_value = temp.split(',')
        print(line_value)
        #append this line to the list
        text.append(line_value)
else:
    sys.exit("file is not ready")

#get number of rows
rows = len(text)

#get number of columns 
cols = len(text[0])
print(cols)
data_complete = True  

for i in range (1, rows):
    if len(text[i]) != cols:
        data_complete = False

#check col number
print(cols)

val = []

if not data_complete:
    sys.exit("file column numbers are not the same, check your file")
else:
    #prepare a 1D list, which has col * row components, col first, then row by row 
    for i in range (1, rows):
        for each in text[i]:
            val.append(each)
print("data is ready")
# ---------- end ghpython_script ----------
panel = Panel(ghpython_script.val)

# ----
range = Range(Domain=Domain(0, 1), Steps=Slider(10, range=0..10))
range_2 = Range(Domain=Domain(0, 1), Steps=Slider(5, range=0..10))
range_3 = Range(Domain=Domain(0, 1), Steps=Slider(3, range=0..10))

# ---- group: Map from pressure to depth
flatten_tree = FlattenTree(Tree=ghpython_script.val, Path="{0}")
bounds = Bounds(Numbers=flatten_tree)
remap_numbers = RemapNumbers(Value=flatten_tree, Source=bounds, Target=Domain(0, 1))  # -> Mapped, Clipped
panel_2 = Panel("maximal depth")
graph_mapper = GraphMapper(remap_numbers.Mapped, x0=0, x1=1, y0=0, y1=1, Gx=0.6028369069, Gy=0.5942028761, Ox=0, Oy=0, container_name="Square Root")
multiplication = Multiplication(A=graph_mapper, B=Slider(-8.2, range=-10..0.5))

# ---- group: 37 * 20 grid
# this number adjust the width & height of the grid. Here we use the same for making it a square
number_slider = Slider(37, range=0..100)
number_slider_2 = Slider(20, range=0..100)
number_slider_3 = Slider(8.6, range=0.1..100)

# ----
ghpython_script_2 = GhPythonScript(x=number_slider, y=number_slider_2)  # -> out, xcoord, ycoord
# ---------- ghpython_script_2: Python ----------
__author__ = "Yu Song"
__version__ = "2021.01.03"

import rhinoscriptsyntax as rs
print(x)
print(y)

xcoord =[]
ycoord =[]
for i in range(0,int(x)):
    for j in range (0,int(y)):
            xcoord.append(str(i))
            ycoord.append(str(j))
# ---------- end ghpython_script_2 ----------

# ---- group: 37 * 20 grid (continued)
multiplication_2 = Multiplication(A=ghpython_script_2.xcoord, B=number_slider_3)
multiplication_3 = Multiplication(A=ghpython_script_2.ycoord, B=number_slider_3)

# ---- group: Generated surface
construct_point = ConstructPoint(XCoordinate=multiplication_2, YCoordinate=multiplication_3, ZCoordinate=multiplication)  # -> simplify(Point)
surface_from_points = SurfaceFromPoints(Points=construct_point, UCount=Slider(37, range=0..100), Interpolate=Slider(20, range=0..100))

# ---- group: Fill between the plane with lattic
unit_z = UnitZ(Factor=Slider(20, range=0.1..20))
move = Move(Geometry=surface_from_points, Motion=unit_z)  # -> Geometry, Transform
merge = Merge(Data1=surface_from_points, Data2=move.Geometry)
range_4 = Range(Domain=Domain(0, 1), Steps=Slider(17, range=3..20))
range_5 = Range(Domain=Domain(0, 1), Steps=Slider(16, range=3..20))
range_6 = Range(Domain=Domain(0, 1), Steps=Slider(3, range=3..20))
crystallonv2_cell_selector = CrystallonV2CellSelector({"Prim. Cubic": 0, "BC": 1, "BC Cubic": 2, "FC Cubic": 3, "Edge Octa.": 4, "Vertex Octa.": 5, "NaCl": 6, "Star Tet.": 7, "BC Star Tet.": 8, "Octa. Tet.": 9, "Dodecahedron": 10, "Trunc. Octa.": 11, "Tetrahedral": 12, "Auxetic": 13, "BC1 (tween)": 14, "BC2 (tween)": 15, "Octa. (shell)": 16, "Dodeca. (shell)": 17, "Trunc. Octa. (shell)": 18, "Gyroid (shell)": 19, "Cubic Center (shell)": 20, "Cubic Face (shell)": 21, "LH Square": 22, "LH Round": 23, "LH Square (shell)": 24, "LH Auxetic (shell)": 25, "MC Tri": 26, "MS Tri (shell)": 27, "MC Quad": 28, "MS Quad (shell)": 29}, selected="BC Cubic")
crystallonv2_morph_between_surfaces = CrystallonV2MorphBetweenSurfaces(surfaces=merge, x_parameter=range_4, y_parameter=range_5, z_parameter=range_6)
crystallonv2_cell_type = CrystallonV2CellType(unit_cell_selector=crystallonv2_cell_selector)
crystallonv2_cell_lattice_fill = CrystallonV2CellLatticeFill(unit_cell=crystallonv2_cell_type, voxels=crystallonv2_morph_between_surfaces)
pipe = Pipe(Curve=crystallonv2_cell_lattice_fill, Radius=Slider(0.8, range=0.1..10), Caps=0)

# ==== cluster CrystallonV2CellType: A collection of pre-made unit cells

crv = Curve([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])
crv_2 = Curve([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])
crv_3 = Curve([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])
crv_4 = Curve([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])
crv_5 = Curve([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])
mesh = Mesh(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)
mesh_2 = Mesh(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)
mesh_3 = Mesh(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)
mesh_4 = Mesh([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])
crv_6 = Curve([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])
crv_7 = Curve([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])
crv_8 = Curve([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])
crv_9 = Curve([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])
crv_10 = Curve([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])
crv_11 = Curve([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])
crv_12 = Curve([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])
crv_13 = Curve([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])
crv_14 = Curve([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])
crv_15 = Curve([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])
crv_16 = Curve([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])
mesh_5 = Mesh(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)
mesh_6 = Mesh(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)
mesh_7 = Mesh(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)
mesh_8 = Mesh(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)
crv_17 = Curve([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])
crv_18 = Curve([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])
mesh_9 = Mesh(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)
geo = Geometry([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])
geo_2 = Geometry([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])
mesh_10 = Mesh([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])
# CRYSTALLON V2.0 -- Lattice structure tools for Grasshopper3D
# 
# Copyright (C) 2019  Aaron Porterfield
# 
# www.fequalsf.com
# info@fequalsf.com
# 
#     This program is free software: you can redistribute it and/or modify
#     it under the terms of the GNU General Public License as published by
#     the Free Software Foundation, either version 3 of the License, or any later version.
# 
#     This program is distributed in the hope that it will be useful,
#     but WITHOUT ANY WARRANTY; without even the implied warranty of
#     MERCHANTABILITY or FITNESS FOR A PARTICULAR PURPOSE.  See the
#     GNU General Public License for more details.
# 
#     You should have received a copy of the GNU General Public License
#     along with this program.  If not, see <http://www.gnu.org/licenses/>.
panel = Panel("CELL TYPES")
entwine = Entwine(
    Branch00=crv_6,
    Branch01=crv_7,
    Branch02=crv,
    Branch03=crv_8,
    Branch04=crv_2,
    Branch05=crv_9,
    Branch06=crv_3,
    Branch07=crv_10,
    Branch08=crv_11,
    Branch09=crv_12,
    Branch010=crv_4,
    Branch011=crv_5,
    Branch012=crv_13,
    Branch013=crv_14,
    Branch014=crv_15,
    Branch015=crv_16,
    Branch016=mesh,
    Branch017=mesh_5,
    Branch018=mesh_6,
    Branch019=mesh_2,
    Branch020=mesh_7,
    Branch021=mesh_8,
    Branch022=crv_17,
    Branch023=crv_18,
    Branch024=mesh_9,
    Branch025=mesh_3,
    Branch026=geo,
    Branch027=mesh_4,
    Branch028=geo_2,
    Branch029=mesh_10,
    FlattenInputs=True)  # -> simplify(Result)
unit_cell_selector = ClusterInput()
branch = TreeBranch(Tree=entwine, Path=unit_cell_selector, MaintainPaths=True)
unit_cell = ClusterOutput(branch)  # Single unit cell to populate voxels

# ==== cluster CrystallonV2CellLatticeFill: Fill voxels with lattice unit cells

unit_cell = ClusterInput()  # Unit cell to populate voxels
voxels = ClusterInput()  # Voxels to be filled with unit cells
crv = Curve(unit_cell)
bbox = BoundingBox(Content=crv, Plane=PlaneXY(0, 0, 0), UnionBox=True)  # -> Box, Box_2
panel = Panel("CELL FILL")
morph = BoxMorph(Geometry=crv, Reference=bbox.Box, Target=graft(voxels))  # -> flatten(Geometry)
remove_duplicate_lines = RemoveDuplicateLines(lattice_l=flatten(morph))
lattice = ClusterOutput(remove_duplicate_lines)  # List of curves that make up the lattice

# ==== cluster CrystallonV2MorphBetweenSurfaces: Conformal fill of voxels between two or more surfaces

x_parameter = ClusterInput()  # Range of numbers (0-1) for X divisions
z_parameter = ClusterInput()  # Range of numbers (0-1) for Z divisions
surfaces = ClusterInput()  # At least 2 surfaces to morph voxels between
y_parameter = ClusterInput()  # Range of numbers (0-1) for Y divisions
srf = Surface(flatten(surfaces))
num = Number(y_parameter)
num_2 = Number(x_parameter)
num_3 = Number(z_parameter)
pt = ConstructPoint(XCoordinate=simplify(graft(num_2)), YCoordinate=simplify(num), ZCoordinate=0)  # -> simplify(Point)
lng = ListLength(List=num_2)
num_4 = Number(lng)
evalsrf = EvaluateSurface(Surface=reparameterize(simplify(srf)), Point=simplify(graft(pt)))  # -> simplify(Point), Normal, Frame
pline = PolyLine(Vertices=evalsrf.Point, Closed=False)
eval = EvaluateCurve(Curve=reparameterize(pline), Parameter=num_3)  # -> Point, Tangent, Angle
path_mapper = PathMapper(eval.Point, source="{A;B}(i)", target="{B;A}(i)")
path_mapper_2 = PathMapper(path_mapper, source="{A;B}", target="{path_index}")
toggle = BooleanToggle(False)
shift = ShiftList(List=path_mapper_2, Shift="1", Wrap=toggle)
shift_2 = ShiftList(List=path_mapper_2, Shift="-1", Wrap=toggle)
flip = FlipMatrix(Data=shift)
flip_2 = FlipMatrix(Data=shift_2)
partition = PartitionList(List=flip_2, Size=num_4)
partition_2 = PartitionList(List=flip, Size=num_4)
shift_3 = ShiftList(List=partition, Shift="-1", Wrap=toggle)  # -> simplify(List)
shift_4 = ShiftList(List=partition, Shift="1", Wrap=toggle)  # -> simplify(List)
shift_5 = ShiftList(List=partition_2, Shift="1", Wrap=toggle)  # -> simplify(List)
shift_6 = ShiftList(List=partition_2, Shift="-1", Wrap=toggle)  # -> simplify(List)
path_mapper_3 = PathMapper(shift_4, source="{A;B}(i)", target="{A;i}(B)")
path_mapper_4 = PathMapper(shift_3, source="{A;B}(i)", target="{A;i}(B)")
path_mapper_5 = PathMapper(shift_5, source="{A;B}(i)", target="{A;i}(B)")
path_mapper_6 = PathMapper(shift_6, source="{A;B}(i)", target="{A;i}(B)")
shift_7 = ShiftList(List=path_mapper_4, Shift="-1", Wrap=toggle)
shift_8 = ShiftList(List=path_mapper_3, Shift="1", Wrap=toggle)
shift_9 = ShiftList(List=path_mapper_3, Shift="-1", Wrap=toggle)
shift_10 = ShiftList(List=path_mapper_6, Shift="-1", Wrap=toggle)
shift_11 = ShiftList(List=path_mapper_4, Shift="1", Wrap=toggle)
shift_12 = ShiftList(List=path_mapper_5, Shift="1", Wrap=toggle)
shift_13 = ShiftList(List=path_mapper_5, Shift="-1", Wrap=toggle)
shift_14 = ShiftList(List=path_mapper_6, Shift="1", Wrap=toggle)
tbox = TwistedBox(
    CornerA=shift_11,
    CornerB=shift_7,
    CornerC=shift_9,
    CornerD=shift_8,
    CornerE=shift_14,
    CornerF=shift_10,
    CornerG=shift_13,
    CornerH=shift_12)
voxels = ClusterOutput(tbox)  # Voxels to be filled with unit cells

# ==== cluster RemoveDuplicateLines
lattice_l = ClusterInput()
crv = Curve(lattice_l)
curvepoint = PointOnCurve(crv, parameter=0.5)
cullpt = CullDuplicates(Points=curvepoint, Tolerance=".001", CullMode=1)  # -> Points, Indices, Valence
item = ListItem(List=crv, Index=cullpt.Indices, Wrap=True)
lattice = ClusterOutput(item)
