# Grasshopper definition GenerativeMesh.gh (Grasshopper 1.0.7)
# plug-ins: Kangaroo2 Components

# ---- group: Create mesh
number_slider = Slider(62, range=0..100)
number_slider_2 = Slider(50, range=0..100)
yz_plane = YZPlane(Origin=Point(0, 0, 0))
xy_plane = XYPlane(Origin=Point(0, 0, 0))
cylinder = Cylinder(Base=yz_plane, Radius=Slider(9, range=0..10), Length=number_slider_2)
cylinder_2 = Cylinder(Base=xy_plane, Radius=Slider(9, range=0..10), Length=number_slider)
division = Division(A=number_slider_2, B=Slider(-2, range=-10..0))
division_2 = Division(A=number_slider, B=Slider(-2, range=-10..0))
unit_z = UnitZ(Factor=division_2)
unit_x = UnitX(Factor=division)
move = Move(Geometry=cylinder_2, Motion=unit_z)  # -> Geometry, Transform
move_2 = Move(Geometry=cylinder, Motion=unit_x)  # -> Geometry, Transform
solid_union = SolidUnion(Breps=[move.Geometry, move_2.Geometry])
settings_custom = SettingsCustom(
    StitchSeams=True,
    SimplePlanes=False,
    Refine=True,
    MinCount=16,
    MaxCount=400,
    AspectRatio=Slider(2, range=0..10),
    MaxDistance=0,
    MaxAngle=20,
    MinEdge=0,
    MaxEdge=0)
mesh_brep = MeshBrep(Brep=solid_union, Settings=settings_custom)

# ----
qrmesh = QuadRemesh(Mesh=mesh_brep, Settings={aqc=True, as=50, dhe=True, gci=0, null=False, pme=0, sa=0, tqc=2000})

# ---- group: Boundary conditions
# Change shape with the slider
shrinking_factor = Slider(1, range=0..1)
nakedvertices = NakedVertices(Mesh=qrmesh)  # -> ClothedIndex, NakedIndex, ClothedPts, NakedPts
edgelengths = EdgeLengths(Mesh=qrmesh, LengthFactor=shrinking_factor, Strength=1)
anchor = Anchor(Point=nakedvertices.NakedPts, Strength=10000)
show = Show(G=qrmesh)

# ----
pt = Point(nakedvertices.NakedPts)

# ---- group: Output
# Click me to reset
button = Button()
# Click to turn on/off
boolean_toggle = BooleanToggle(True)
bouncysolver = BouncySolver(
    GoalObjects=[show, edgelengths, anchor],
    Reset=button,
    Threshold=1e-15,
    Tolerance=0.01,
    Damping=0.99,
    Iterations=10,
    On=boolean_toggle)  # -> I, V, O
panel = Panel(bouncysolver.I)
list_item = ListItem(List=bouncysolver.O, Index=0, Wrap=True)
panel_2 = Panel(bouncysolver.O)
mesh = Mesh(list_item)

# ----
preview = CustomPreview(Geometry=mesh, Material=ColourSwatch(SwatchColor=RGB(163, 207, 214)))
