# Grasshopper definition Digital Fabrication Laser Cutting.gh (Grasshopper 1.0.7)
# plug-ins: UnifyUVs2

curve = Curve(<curve referenced from the Rhino model>)
yz_plane = YZPlane(Origin=Point(0, 0, 0))
curve_2 = Curve(<curve referenced from the Rhino model>)
curve_3 = Curve(<curve referenced from the Rhino model>)
explode = Explode(Curve=curve_2, Recursive=True)  # -> Segments, Vertices
sweep2 = Sweep2(Rail1=curve_3, Rail2=curve_2, Sections=curve, SameHeight=False)
xz_plane = XZPlane(Origin=Point(0, 0, 0))
list_item = ListItem(List=explode.Vertices, Index=0, Wrap=True)  # -> Item, Item1
xz_plane_2 = XZPlane(Origin=list_item.Item1)
number_slider = Slider(7, range=0..10)
plane_surface = PlaneSurface(Plane=xz_plane_2, XSize=Domain(-100, 100), YSize=Domain(-100, 100))
split_brep = SplitBrep(Brep=sweep2, Cutter=plane_surface)
list_item_2 = ListItem(List=split_brep, Index=0, Wrap=True)
mirror = Mirror(Geometry=list_item_2, Plane=xz_plane)  # -> Geometry, Transform
brep_join = BrepJoin(Breps=[list_item_2, mirror.Geometry])  # -> Breps, Closed
bounding_box = BoundingBox(Content=brep_join.Breps, Plane=PlaneXY(0, 0, 0))  # -> Box, Box_2
deconstruct_brep = DeconstructBrep(Brep=bounding_box.Box)  # -> Faces, Edges, Vertices
deconstruct_brep_2 = DeconstructBrep(Brep=bounding_box.Box)  # -> Faces, Edges, Vertices
list_item_3 = ListItem(List=deconstruct_brep.Edges, Index=Slider(3, range=0..10), Wrap=True)
list_item_4 = ListItem(List=deconstruct_brep_2.Edges, Index=Slider(8, range=0..10), Wrap=True)
perp_frames = PerpFrames(Curve=list_item_3, Count=Slider(6, range=0..100), Align=True)  # -> Frames, Parameters
perp_frames_2 = PerpFrames(Curve=list_item_4, Count=Slider(5, range=0..100), Align=True)  # -> Frames, Parameters
brep_plane = BrepPlane(Brep=brep_join.Breps, Plane=perp_frames.Frames)  # -> Curves, Points
project = Project(Geometry=brep_plane.Curves, Plane=yz_plane)  # -> Geometry, Transform
brep_plane_2 = BrepPlane(Brep=brep_join.Breps, Plane=perp_frames_2.Frames)  # -> Curves, Points
project_2 = Project(Geometry=brep_plane_2.Curves, Plane=yz_plane)  # -> Geometry, Transform
edge_surface = EdgeSurface(CurveA=brep_plane.Curves, CurveB=project.Geometry)
xy_plane = XYPlane(Origin=Point(0, 0, 0))
edge_surface_2 = EdgeSurface(CurveA=brep_plane_2.Curves, CurveB=project_2.Geometry)
list_item_5 = ListItem(List=flatten(edge_surface), Index=0, Wrap=True)
list_item_6 = ListItem(List=flatten(edge_surface_2), Index=0, Wrap=True)
evaluate_surface = EvaluateSurface(Surface=edge_surface, Point=xy_plane)  # -> Point, Normal, UDirection, VDirection, Frame
list_item_7 = ListItem(List=flatten(edge_surface), Index=0, Wrap=True)
retrim = Retrim(Source=list_item_7, Target=flatten(edge_surface))
flip = Flip(Surface=flatten(edge_surface), Guide=list_item_7)  # -> Surface, Result
unify_uvs = UnifyUVs(
    GuideSurface=list_item_6,
    SetOfSurfaces=edge_surface_2,
    ShrinkSurface=False,
    DisplayUVWOrientation=False,
    Opt_Style=False,
    Shrink=False,
    UVDisplay=False)  # -> Message, UnifiedUVsSurfaces
is_planar = IsPlanar(Surface=edge_surface, Interior=True)  # -> Planar, Plane
unify_uvs_2 = UnifyUVs(
    GuideSurface=list_item_7,
    SetOfSurfaces=edge_surface,
    ShrinkSurface=False,
    DisplayUVWOrientation=False,
    Opt_Style=False,
    Shrink=False,
    UVDisplay=False)  # -> Message, UnifiedUVsSurfaces
region_slits = RegionSlits(
    Regions=reparameterize(flatten([unify_uvs.UnifiedUVsSurfaces, unify_uvs_2.UnifiedUVsSurfaces])),
    Width=Slider(0.4, range=0..1),
    Gap=0)  # -> flatten(Regions), Topology
sift_pattern = SiftPattern(List=flip.Surface, SiftPattern=flip.Result)  # -> Output0, Output1
xy_plane_2 = XYPlane(Origin=Point(0, 0, 0))
list_item_8 = ListItem(List=region_slits.Regions, Index=Slider(20, range=0..20), Wrap=True)
clean_tree = CleanTree(RemoveNulls=True, RemoveInvalid=True, RemoveEmpty=False, Tree=sift_pattern.Output1)
clean_tree_2 = CleanTree(RemoveNulls=True, RemoveInvalid=True, RemoveEmpty=False, Tree=sift_pattern.Output0)

# ---- group: U - Direction Vector
eval = EvaluateSurface(Surface=reparameterize(edge_surface), Point=[Point(0, 0, 0), Point(1, 0, 0)])  # -> Point, Normal, Frame
item = ListItem(List=eval.Point, Index=0, Wrap=False)
item_2 = ListItem(List=eval.Point, Index=1, Wrap=False)
vec2pt = Vector2Pt(PointA=item, PointB=item_2, Unitize=False)  # -> Vector, Length

# ----
evaluate_surface_2 = EvaluateSurface(Surface=reparameterize(unify_uvs.UnifiedUVsSurfaces), Point=xy_plane_2)  # -> Point, Normal, UDirection, VDirection, Frame

# ---- group: Swap UV
c_script = CSharpScript(S=clean_tree_2)  # -> out, A; inputs S: Surface
# ---------- c_script: C# usings ----------
using System.IO;
using System.Linq;
using System.Data;
using System.Drawing;
using System.Reflection;
using System.Windows.Forms;
using System.Xml;
using System.Xml.Linq;
using System.Runtime.InteropServices;

using Rhino.DocObjects;
using Rhino.Collections;
using GH_IO;
using GH_IO.Serialization;
# ---------- c_script: C# ----------
    A = S.Transpose();
# ---------- end c_script ----------

# ----
vdis = VectorDisplay(Anchor=item, Vector=vec2pt.Vector)

# ---- group: U - Direction Vector
eval_2 = EvaluateSurface(Surface=reparameterize(c_script.A), Point=[Point(0, 0, 0), Point(1, 0, 0)])  # -> Point, Normal, Frame
item_3 = ListItem(List=eval_2.Point, Index=0, Wrap=False)
item_4 = ListItem(List=eval_2.Point, Index=1, Wrap=False)
vec2pt_2 = Vector2Pt(PointA=item_3, PointB=item_4, Unitize=False)  # -> Vector, Length

# ----
merge = Merge(Data1=c_script.A, Data2=clean_tree)
surface = Surface(c_script.A)
evaluate_surface_3 = EvaluateSurface(Surface=reparameterize(unify_uvs_2.UnifiedUVsSurfaces), Point=xy_plane)  # -> Point, Normal, UDirection, VDirection, Frame
vdis_2 = VectorDisplay(Anchor=item_3, Vector=vec2pt_2.Vector)
