# Grasshopper definition 2023_A2_example.gh (Grasshopper 1.0.7)
# plug-ins: Weaverbird, Pufferfish, LunchBox

mesh = Mesh(<mesh referenced from the Rhino model>)

# ---- group: Mesh align to xy plane
weaverbird_s_naked_boundary = WeaverbirdsNakedBoundary(MeshClosedPolylines=mesh)
list_item = ListItem(List=weaverbird_s_naked_boundary, Index=Slider(1, range=0..5), Wrap=True)
explode = Explode(Curve=list_item, Recursive=True)  # -> Segments, Vertices
plane_fit = PlaneFit(Points=explode.Vertices)  # -> Plane, Deviation
xy_plane = XYPlane(Origin=Point(0, 0, 0))
orient = Orient(Geometry=mesh, Source=plane_fit.Plane, Target=xy_plane)  # -> Geometry, Transform

# ---- group: Simplify mesh for speed
deconstruct_mesh = DeconstructMesh(Mesh=orient.Geometry)  # -> Vertices, Faces, Colours, Normals
list_length = ListLength(List=deconstruct_mesh.Faces)
division = Division(A=list_length, B=Slider(4.976, range=1..20))
reduce_mesh = ReduceMesh(Mesh=orient.Geometry, FaceCount=division, Accuracy=1, FaceType=0, Distort=True, Normalize=False)  # -> Reduced, CountDifference

# ----
construct_point = ConstructPoint(XCoordinate=0, YCoordinate=0, ZCoordinate=Slider(43.529, range=0..50))
construct_point_2 = ConstructPoint(XCoordinate=0, YCoordinate=0, ZCoordinate=Slider(-15.2, range=-20..0))
construct_point_3 = ConstructPoint(XCoordinate=0, YCoordinate=0, ZCoordinate=Slider(54, range=0..100))
construct_point_4 = ConstructPoint(XCoordinate=0, YCoordinate=0, ZCoordinate=Slider(-3.1, range=-20..0))
line = Line(StartPoint=construct_point_2, EndPoint=construct_point)
line_2 = Line(StartPoint=construct_point_4, EndPoint=construct_point_3)
mesh_2 = Mesh(reduce_mesh.Reduced)
pipe = Pipe(Curve=line, Radius=Slider(23, range=0..100), Caps=Slider(1, range=0..2))
pipe_2 = Pipe(Curve=line_2, Radius=Slider(23, range=0..100), Caps=Slider(1, range=0..2))
mesh_to_polysurface = MeshToPolysurface(Mesh=mesh_2, Triangles=False, FaceMerge=False)
brep = Brep(pipe_2)
split_brep = SplitBrep(Brep=brep, Cutter=mesh_to_polysurface)
split_brep_2 = SplitBrep(Brep=pipe, Cutter=mesh_to_polysurface)
split_brep_3 = SplitBrep(Brep=mesh_to_polysurface, Cutter=brep)
list_item_2 = ListItem(List=split_brep_2, Index=Slider(1, range=0..5), Wrap=True)
list_item_3 = ListItem(List=split_brep_3, Index=Slider(0, range=0..5), Wrap=True)
list_item_4 = ListItem(List=split_brep, Index=Slider(2, range=0..5), Wrap=True)
brep_2 = Brep(list_item_3)
brep_3 = Brep(list_item_4)
brep_4 = Brep(list_item_2)
merge = Merge(Data1=brep_2, Data2=brep_3, Data3=brep_4)
brep_join = BrepJoin(Breps=merge)  # -> Breps, Closed
mesh_brep = MeshBrep(
    Brep=brep_join.Breps,
    Settings={GridMaxCount=0, GridMinCount=16, JaggedSeams=False, MaxEdgeLength=0, MinEdgeLength=0.0001, MinTolerance=0, Refine=True, RefineAngle=0, RelativeTolerance=0.65, SimplePlanes=True, Tolerance=0})
weaverbird_s_join_meshes_and_weld = WeaverbirdsJoinMeshesAndWeld(Mesh=mesh_brep, Weld=False)
mesh_reduce = MeshReduce(
    Mesh=flatten(weaverbird_s_join_meshes_and_weld),
    TargetSize=Slider(4163, range=0..10000),
    Distort=True,
    Accuracy=5,
    NormalizeSize=False)
mesh_to_polysurface_2 = MeshToPolysurface(Mesh=mesh_reduce, Triangles=False, FaceMerge=Toggle(False))
