# Grasshopper definition Generating a Mesh from Ear Canal Cavity (Kangaroo Physics).gh (Grasshopper 1.0.7)
# plug-ins: Weaverbird, Pufferfish, LunchBox, Kangaroo2 Components, DendroGH

mesh = Mesh(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)

# ---- group: Mesh align to xy plane
weaverbird_s_naked_boundary = WeaverbirdsNakedBoundary(MeshClosedPolylines=mesh)
list_item = ListItem(List=weaverbird_s_naked_boundary, Index=Slider(1, range=0..5), Wrap=True)
explode = Explode(Curve=list_item, Recursive=True)  # -> Segments, Vertices
plane_fit = PlaneFit(Points=explode.Vertices)  # -> Plane, Deviation
xy_plane = XYPlane(Origin=Point(0, 0, 0))
orient = Orient(Geometry=mesh, Source=plane_fit.Plane, Target=xy_plane)  # -> Geometry, Transform

# ---- group: Simplify mesh for speed
deconstruct_mesh = DeconstructMesh(Mesh=orient.Geometry)  # -> Vertices, Faces, Colours, Normals
list_length = ListLength(List=deconstruct_mesh.Faces)
division = Division(A=list_length, B=Slider(4.976, range=1..20))
reduce_mesh = ReduceMesh(Mesh=orient.Geometry, FaceCount=division, Accuracy=1, FaceType=0, Distort=True, Normalize=False)  # -> Reduced, CountDifference

# ---- group: Generating Cylinder Boundary for Mesh
construct_point = ConstructPoint(XCoordinate=0, YCoordinate=0, ZCoordinate=Slider(43.529, range=0..50))
construct_point_2 = ConstructPoint(XCoordinate=0, YCoordinate=0, ZCoordinate=Slider(-15.2, range=-20..0))
construct_point_3 = ConstructPoint(XCoordinate=0, YCoordinate=0, ZCoordinate=Slider(54, range=0..100))
construct_point_4 = ConstructPoint(XCoordinate=0, YCoordinate=0, ZCoordinate=Slider(-3.1, range=-20..0))
line = Line(StartPoint=construct_point_2, EndPoint=construct_point)
line_2 = Line(StartPoint=construct_point_4, EndPoint=construct_point_3)
pipe = Pipe(Curve=line, Radius=Slider(23, range=0..100), Caps=Slider(1, range=0..2))
pipe_2 = Pipe(Curve=line_2, Radius=Slider(23, range=0..100), Caps=Slider(1, range=0..2))

# ----
mesh_2 = Mesh(reduce_mesh.Reduced)
mesh_to_polysurface = MeshToPolysurface(Mesh=mesh_2, Triangles=False, FaceMerge=False)
brep = Brep(pipe_2)

# ---- group: Cutting 3D scan to fit boundary
split_brep = SplitBrep(Brep=brep, Cutter=mesh_to_polysurface)
split_brep_2 = SplitBrep(Brep=pipe, Cutter=mesh_to_polysurface)
split_brep_3 = SplitBrep(Brep=mesh_to_polysurface, Cutter=brep)
list_item_2 = ListItem(List=split_brep_2, Index=Slider(1, range=0..5), Wrap=True)
list_item_3 = ListItem(List=split_brep_3, Index=Slider(0, range=0..5), Wrap=True)
list_item_4 = ListItem(List=split_brep, Index=Slider(2, range=0..5), Wrap=True)
brep_2 = Brep(list_item_3)
brep_3 = Brep(list_item_4)
brep_4 = Brep(list_item_2)
merge = Merge(Data1=brep_2, Data2=brep_3, Data3=brep_4)
brep_join = BrepJoin(Breps=merge)  # -> Breps, Closed

# ---- group: Simplifying the mesh
mesh_brep = MeshBrep(
    Brep=brep_join.Breps,
    Settings={GridMaxCount=0, GridMinCount=16, JaggedSeams=False, MaxEdgeLength=0, MinEdgeLength=0.0001, MinTolerance=0, Refine=True, RefineAngle=0, RelativeTolerance=0.65, SimplePlanes=True, Tolerance=0})
weaverbird_s_join_meshes_and_weld = WeaverbirdsJoinMeshesAndWeld(Mesh=mesh_brep, Weld=False)
mesh_reduce = MeshReduce(
    Mesh=flatten(weaverbird_s_join_meshes_and_weld),
    TargetSize=Slider(4030, range=0..10000),
    Distort=True,
    Accuracy=5,
    NormalizeSize=False)

# ---- group: Generating collision spheres
construct_point_5 = ConstructPoint(
    XCoordinate=Slider(-4.885, range=-100..0),
    YCoordinate=Slider(-11.551, range=-100..0),
    ZCoordinate=Slider(28, range=10..100))
construct_point_6 = ConstructPoint(XCoordinate=Slider(7, range=0..100), YCoordinate=Slider(-1.1, range=-5..10), ZCoordinate=Slider(318, range=50..500))
box_2pt = Box2Pt(PointA=construct_point_5, PointB=construct_point_6, Plane=PlaneXY(0, 0, 0))
populate_geometry = PopulateGeometry(Geometry=box_2pt, Count=Slider(1000, range=10..10000), Seed=1)

# ----
panel = Panel(mesh_reduce)

# ---- group: Boundary conditions
number_slider = Slider(0.5, range=0..3)
unit_z = UnitZ(Factor=Slider(-0.135, range=-1..0))
load = Load(Point=populate_geometry, ForceVector=unit_z, Weighting=1)
solidpointcollide = SolidPointCollide(Points=populate_geometry, Solid=mesh_reduce, Interior=False, Unidirectional=True, Strength=Slider(7, range=0..100))
show = Show(G=populate_geometry)
spherecollide = SphereCollide(Points=populate_geometry, Radius=number_slider, Strength=1)

# ---- group: Solvers
merge_2 = Merge(Data1=spherecollide, Data2=load, Data3=show, Data4=solidpointcollide)
bouncysolver = BouncySolver(
    GoalObjects=merge_2,
    Reset=Button(),
    Threshold=1e-15,
    Tolerance=0.01,
    Damping=Slider(0.96, range=0..1),
    Iterations=10,
    On=Toggle(False))  # -> I, V, O

# ---- group: Generating boundary volume and coverting to mesh
clean = CleanTree(RemoveNulls=True, RemoveInvalid=True, RemoveEmpty=False, Tree=bouncysolver.O)
create_settings = CreateSettings(VoxelSize=Slider(0.8, range=0..2), Bandwidth=1, Isovalue=0, Adaptivity=0.1)
create_settings_2 = CreateSettings(VoxelSize=Slider(0.5, range=0..2), Bandwidth=1, Isovalue=0, Adaptivity=0.1)

# ---- group: Generating boundary volume and coverting to mesh / Display
mesh_sphere = MeshSphere(Base=clean, Radius=number_slider, UCount=10, VCount=20)

# ---- group: Generating boundary volume and coverting to mesh (continued)
volume = Volume(Geometry=mesh_sphere)  # -> Volume, Centroid
panel_2 = Panel(volume.Centroid)
points_to_volume = PointsToVolume(Points=volume.Centroid, PointRadius=Slider(0.8, range=0..2), Settings=create_settings)
smooth_volume = SmoothVolume(Volume=points_to_volume, Width=1, Type=2, Iterations=1)
volume_to_mesh = VolumeToMesh(Volume=smooth_volume, VolumeSettings=create_settings_2)
