# Grasshopper definition ParametricSunglasses.gh (Grasshopper 1.0.7)

# ----
# Select two points on the mesh
# (top of ear and bridge of nose)
pt = Point([Point(-79.35808553, 17.18512276, 91.21990733), Point(-0.8917998696, -106.0641011, 64.90950018)])

pt_2 = Point([Point(-74.4943488, 40.64971556, 70.55217062), Point(-79.41765781, 16.07671851, 93.76652828), Point(-61.64079722, -105.8299542, 68.61079034)])
item = ListItem(List=pt, Index=0, Wrap=True)  # -> Item, Item1
geo = Geometry(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)
area = Area(Geometry=geo)  # -> Area, Centroid
pdecon = Deconstruct(Point=item.Item)  # -> XComponent, YComponent, ZComponent
pdecon_2 = Deconstruct(Point=item.Item)  # -> XComponent, YComponent, ZComponent
pdecon_3 = Deconstruct(Point=item.Item1)  # -> XComponent, YComponent, ZComponent
scale = Scale(Geometry=geo, Center=area.Centroid, Factor=Slider(1000, range=0..1000))  # -> Geometry, Transform
addition = Addition(A=pdecon_2.YComponent, B=Slider(20, range=0..100))
geo_2 = Geometry(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)
subtraction = Subtraction(A=pdecon_2.ZComponent, B=Slider(25, range=0..100))
subtraction_2 = Subtraction(A=pdecon.XComponent, B=Slider(6, range=0..100))
addition_2 = Addition(A=pdecon_2.XComponent, B=Slider(14.5, range=0..100))
pt_3 = ConstructPoint(XCoordinate=addition_2, YCoordinate=pdecon_3.YComponent, ZCoordinate=pdecon_3.ZComponent)
pt_4 = ConstructPoint(XCoordinate=subtraction_2, YCoordinate=pdecon.YComponent, ZCoordinate=pdecon.ZComponent)
pt_5 = ConstructPoint(XCoordinate=pdecon_2.XComponent, YCoordinate=addition, ZCoordinate=subtraction)
preview = CustomPreview(Geometry=scale.Geometry, Material=ColourSwatch(SwatchColor=RGB(255, 254, 254)))
dist = Distance(PointA=item.Item1, PointB=pt_3)
neg = Negative(Value=Slider(6.9, range=0..100))
merge = Merge(Data1=pt_5, Data2=pt_4, Data3=pt_3)
pt_6 = Point(merge)
pline = PolyLine(Vertices=pt_6, Closed=False)
explode = Explode(Curve=pline, Recursive=True)  # -> Segments, Vertices
pipe = Pipe(Curve=pline, Radius=Slider(2, range=0..10), Caps=2)
item_2 = ListItem(List=explode.Vertices, Index=0, Wrap=True)  # -> Item, Item1, Item2
item_3 = ListItem(List=explode.Segments, Index=0, Wrap=True)  # -> Item, Item1
pdecon_4 = Deconstruct(Point=item_2.Item2)  # -> XComponent, YComponent, ZComponent
pln = Plane(item_3.Item1)
multiplication = Multiplication(A=neg, B=0.01745329252)
xy = XYPlane(Origin=Point(0, 0, 0))
rotate = Rotate(Geometry=pln, Angle=multiplication, Plane=xy)  # -> Geometry, Transform
division = Division(A=dist, B=Slider(2.4, range=0..10))
addition_3 = Addition(A=pdecon_4.XComponent, B=division)
pt_7 = ConstructPoint(XCoordinate=addition_3, YCoordinate=pdecon_4.YComponent, ZCoordinate=pdecon_4.ZComponent)
pl_origin = PlaneOrigin(Base=rotate.Geometry, Origin=pt_7)
cir = Circle(Plane=pl_origin, Radius=division)
neg_2 = Negative(Value=Slider(3.5, range=0..100))
vec = Vector(pl_origin)
subtraction_3 = Subtraction(A=division, B=Slider(3, range=0..100))
pdecon_5 = Deconstruct(Point=pt_7)  # -> XComponent, YComponent, ZComponent
neg_3 = Negative(Value=Slider(4.6, range=0..10))
offset = OffsetCurve(Curve=cir, Distance=neg_2, Corners=1)
multiplication_2 = Multiplication(A=vec, B=neg_3)
addition_4 = Addition(A=pdecon_5.XComponent, B=subtraction_3)
addition_5 = Addition(A=pdecon_5.ZComponent, B=Slider(6.5, range=0..100))
merge_2 = Merge(Data1=offset, Data2=cir)  # -> flatten(Result)
pt_8 = ConstructPoint(XCoordinate=addition_4, YCoordinate=pdecon_5.YComponent, ZCoordinate=addition_5)
loft = Loft(Curves=merge_2, Options={Adjust=False, Closed=False, LoftEnds=0, LoftSimp=0, LoftType=0, Rebuild=10, Refit=0.01})
cap = CapHoles(Brep=pipe)
mirror = Mirror(Geometry=pt_8, Plane=PlaneYZ(0, 0, 0))  # -> Geometry, Transform
extr = Extrude(Base=loft, Direction=multiplication_2)  # -> flatten(Extrusion)
merge_3 = Merge(Data1=extr, Data2=cap)  # -> flatten(Result)
ln = Line(StartPoint=pt_8, EndPoint=mirror.Geometry)
join = BrepJoin(Breps=merge_3)  # -> Breps, Closed
pipe_2 = Pipe(Curve=ln, Radius=Slider(1.4, range=0..10), Caps=2)
mirror_2 = Mirror(Geometry=join.Breps, Plane=PlaneYZ(0, 0, 0))  # -> Geometry, Transform
merge_4 = Merge(Data1=join.Breps, Data2=mirror_2.Geometry, Data3=pipe_2)  # -> flatten(Result)
join_2 = BrepJoin(Breps=merge_4)  # -> Breps, Closed
preview_2 = CustomPreview(Geometry=join_2.Breps, Material=ColourSwatch(SwatchColor=RGB(97, 97, 97)))
