# Grasshopper definition 08.01.Data_driven_foot.gh (Grasshopper 1.0.7)

# ---- group: 37 * 20 grid
# this number adjust the width & height of the grid. Here we use the same for making it a square
number_slider = Slider(37, range=0..100)
number_slider_2 = Slider(4.6, range=0.1..100)
ghpython_script = GhPythonScript(x=number_slider, y=Slider(20, range=0..100))  # -> out, xcoord, ycoord
# ---------- ghpython_script: Python ----------
__author__ = "Yu Song"
__version__ = "2021.01.03"

import rhinoscriptsyntax as rs
print(x)
print(y)

xcoord =[]
ycoord =[]
for i in range(0,int(x)):
    for j in range (0,int(y)):
            xcoord.append(str(i))
            ycoord.append(str(j))
# ---------- end ghpython_script ----------
multiplication = Multiplication(A=ghpython_script.xcoord, B=number_slider_2)
multiplication_2 = Multiplication(A=ghpython_script.ycoord, B=number_slider_2)

# ----
file_path = FilePath("C:\Users\jobba\OneDrive - Delft University of Technology\Computational Design 4 Digital Fabrication\01.Lectures_Workshops\Week 8\footPressure.csv")

# ---- group: Input data
panel = Panel("D:\\footPressure.csv")
ghpython_script_2 = GhPythonScript(filename=file_path)  # -> out, val
# ---------- ghpython_script_2: Python ----------
__author__ = "Yu Song"
__version__ = "2020.05.02"

import rhinoscriptsyntax as rs
import sys
import os

cwd = os.getcwd()+"\\"+filename
#check inputs
print(cwd)

#open file
f = open(filename,"r")

#empty list
text = []

#read file line by line
if f.mode == 'r':
    #read a line
    f1 = f.readlines()
    for x in f1:
        print (x)
        #remove "\n" i.e. return in the graph
        temp = x.rstrip()
        print (temp)
        #split text by comma "," 
        line_value = temp.split(',')
        print(line_value)
        #append this line to the list
        text.append(line_value)
else:
    sys.exit("file is not ready")

#get number of rows
rows = len(text)

#get number of columns 
cols = len(text[0])
print(cols)
data_complete = True  

for i in range (1, rows):
    if len(text[i]) != cols:
        data_complete = False

#check col number
print(cols)

val = []

if not data_complete:
    sys.exit("file column numbers are not the same, check your file")
else:
    #prepare a 1D list, which has col * row components, col first, then row by row 
    for i in range (1, rows):
        for each in text[i]:
            val.append(each)
print("data is ready")
# ---------- end ghpython_script_2 ----------
panel_2 = Panel(ghpython_script_2.val)

# ---- group: Map from pressure to depth
bounds = Bounds(Numbers=ghpython_script_2.val)
remap_numbers = RemapNumbers(Value=ghpython_script_2.val, Source=bounds, Target=Domain(0, 1))  # -> Mapped, Clipped
panel_3 = Panel("maximal depth")
graph_mapper = GraphMapper(remap_numbers.Mapped, x0=0, x1=1, y0=0, y1=1, Gx=0.7408698201, Gy=0.5582242012, Ox=0, Oy=0, container_name="Square Root")
multiplication_3 = Multiplication(A=graph_mapper, B=Slider(-10, range=-10..0.5))

# ---- group: Generated surface
construct_point = ConstructPoint(XCoordinate=multiplication, YCoordinate=multiplication_2, ZCoordinate=multiplication_3)  # -> simplify(Point)
surface_from_points = SurfaceFromPoints(Points=construct_point, UCount=Slider(37, range=0..100), Interpolate=Slider(20, range=0..100))
