# Grasshopper definition 08.02.Data_driven_foot_lattice_method_1.gh (Grasshopper 1.0.7)
# Copyright: ©2019 GNU General Public License

# ---- group: Input data
ghpython_script = GhPythonScript(filename="D:\\footPressure.csv")  # -> out, val
# ---------- ghpython_script: Python ----------
__author__ = "Yu Song"
__version__ = "2020.05.02"

import rhinoscriptsyntax as rs
import sys
#check inputs
print(filename)

#open file
f = open(filename,"r")

#empty list
text = []

#read file line by line
if f.mode == 'r':
    #read a line
    f1 = f.readlines()
    for x in f1:
        print (x)
        #remove "\n" i.e. return in the graph
        temp = x.rstrip()
        print (temp)
        #split text by comma "," 
        line_value = temp.split(',')
        print(line_value)
        #append this line to the list
        text.append(line_value)
else:
    sys.exit("file is not ready")

#get number of rows
rows = len(text)

#get number of columns 
cols = len(text[0])
print(cols)
data_complete = True  

for i in range (1, rows):
    if len(text[i]) != cols:
        data_complete = False

#check col number
print(cols)

val = []

if not data_complete:
    sys.exit("file column numbers are not the same, check your file")
else:
    #prepare a 1D list, which has col * row components, col first, then row by row 
    for i in range (1, rows):
        for each in text[i]:
            val.append(each)
print("data is ready")
# ---------- end ghpython_script ----------
panel = Panel(ghpython_script.val)

# ---- group: Map from pressure to depth
flatten_tree = FlattenTree(Tree=ghpython_script.val, Path="{0}")
bounds = Bounds(Numbers=flatten_tree)
remap_numbers = RemapNumbers(Value=flatten_tree, Source=bounds, Target=Domain(0, 1))  # -> Mapped, Clipped
panel_2 = Panel("maximal depth")
graph_mapper = GraphMapper(remap_numbers.Mapped, x0=0, x1=1, y0=0, y1=1, Gx=0.6028369069, Gy=0.5942028761, Ox=0, Oy=0, container_name="Square Root")
multiplication = Multiplication(A=graph_mapper, B=Slider(-8.2, range=-10..0.5))

# ---- group: 37 * 20 grid
# this number adjust the width & height of the grid. Here we use the same for making it a square
number_slider = Slider(37, range=0..100)
number_slider_2 = Slider(20, range=0..100)
number_slider_3 = Slider(8.6, range=0.1..100)

# ----
ghpython_script_2 = GhPythonScript(x=number_slider, y=number_slider_2)  # -> out, xcoord, ycoord
# ---------- ghpython_script_2: Python ----------
__author__ = "Yu Song"
__version__ = "2021.01.03"

import rhinoscriptsyntax as rs
print(x)
print(y)

xcoord =[]
ycoord =[]
for i in range(0,int(x)):
    for j in range (0,int(y)):
            xcoord.append(str(i))
            ycoord.append(str(j))
# ---------- end ghpython_script_2 ----------

# ---- group: 37 * 20 grid (continued)
multiplication_2 = Multiplication(A=ghpython_script_2.xcoord, B=number_slider_3)
multiplication_3 = Multiplication(A=ghpython_script_2.ycoord, B=number_slider_3)

# ---- group: Generated surface
construct_point = ConstructPoint(XCoordinate=multiplication_2, YCoordinate=multiplication_3, ZCoordinate=multiplication)  # -> simplify(Point)
surface_from_points = SurfaceFromPoints(Points=construct_point, UCount=Slider(37, range=0..100), Interpolate=Slider(20, range=0..100))

# ---- group: Fill between the plane with lattic
unit_z = UnitZ(Factor=Slider(20, range=0.1..20))
move = Move(Geometry=surface_from_points, Motion=unit_z)  # -> Geometry, Transform
number_slider_4 = Slider(7, range=3..20)
crystallonv2_cell_selector = CrystallonV2CellSelector({"Prim. Cubic": 0, "BC": 1, "BC Cubic": 2, "FC Cubic": 3, "Edge Octa.": 4, "Vertex Octa.": 5, "NaCl": 6, "Star Tet.": 7, "BC Star Tet.": 8, "Octa. Tet.": 9, "Dodecahedron": 10, "Trunc. Octa.": 11, "Tetrahedral": 12, "Auxetic": 13, "BC1 (tween)": 14, "BC2 (tween)": 15, "Octa. (shell)": 16, "Dodeca. (shell)": 17, "Trunc. Octa. (shell)": 18, "Gyroid (shell)": 19, "Cubic Center (shell)": 20, "Cubic Face (shell)": 21, "LH Square": 22, "LH Round": 23, "LH Square (shell)": 24, "LH Auxetic (shell)": 25, "MC Tri": 26, "MS Tri (shell)": 27, "MC Quad": 28, "MS Quad (shell)": 29}, selected="BC Cubic")
xy_plane = XYPlane(Origin=Point(0, 0, 0))
crystallonv2_cell_type = CrystallonV2CellType(unit_cell_selector=crystallonv2_cell_selector)
crystallonv2_voxelize_distance = CrystallonV2VoxelizeDistance(
    geometry=move.Geometry,
    plane=xy_plane,
    voxel_size_x=number_slider_4,
    voxel_size_y=number_slider_4,
    voxel_size_z=number_slider_4,
    fill_completely=Toggle(True))
crystallonv2_cell_lattice_fill = CrystallonV2CellLatticeFill(unit_cell=crystallonv2_cell_type, voxels=crystallonv2_voxelize_distance)
pipe = Pipe(Curve=crystallonv2_cell_lattice_fill, Radius=Slider(0.1, range=0.1..10), Caps=0)

# ==== cluster CrystallonV2VoxelizeDistance: Fill a volume with equal sized voxels

voxel_size_x = ClusterInput()  # Voxel size int the X direction
voxel_size_y = ClusterInput()  # Voxel size int the Y direction
voxel_size_z = ClusterInput()  # Voxel size int the Z direction
plane = ClusterInput()  # Base plane for voxels
geometry = ClusterInput()  # Geometry to voxelize
fill_completely = ClusterInput()  # If true, Voxels will fill entire volume. If false, only Voxels with their centroid within the volume will be kept.
mesh = Mesh(geometry)
pln = Plane(plane)
num = Number(voxel_size_x)
num_2 = Number(voxel_size_y)
num_3 = Number(voxel_size_z)
bool = Boolean(fill_completely)
bbox = BoundingBox(Content=mesh, Plane=pln)  # -> Box, Box_2
edges = BrepEdges(Brep=bbox.Box)  # -> Naked, Interior, NonManifold
item = ListItem(List=edges.Interior, Index="8", Wrap=True)
item_2 = ListItem(List=edges.Interior, Index="1", Wrap=True)
# CRYSTALLON V2.0 -- Lattice structure tools for Grasshopper3D
# 
# Copyright (C) 2019  Aaron Porterfield
# 
# www.fequalsf.com
# info@fequalsf.com
# 
#     This program is free software: you can redistribute it and/or modify
#     it under the terms of the GNU General Public License as published by
#     the Free Software Foundation, either version 3 of the License, or any later version.
# 
#     This program is distributed in the hope that it will be useful,
#     but WITHOUT ANY WARRANTY; without even the implied warranty of
#     MERCHANTABILITY or FITNESS FOR A PARTICULAR PURPOSE.  See the
#     GNU General Public License for more details.
# 
#     You should have received a copy of the GNU General Public License
#     along with this program.  If not, see <http://www.gnu.org/licenses/>.
item_3 = ListItem(List=edges.Interior, Index="0", Wrap=True)
divlength = DivideLength(Curve=reparameterize(item_2), Length=num_2)  # -> Points, Tangents, Parameters
divlength_2 = DivideLength(Curve=reparameterize(item_3), Length=num)  # -> Points, Tangents, Parameters
divlength_3 = DivideLength(Curve=reparameterize(item), Length=num_3)  # -> Points, Tangents, Parameters
reldif = RelativeDifferences(Values=divlength.Parameters)
reldif_2 = RelativeDifferences(Values=divlength_2.Parameters)
reldif_3 = RelativeDifferences(Values=divlength_3.Parameters)
item_4 = ListItem(List=reverse(divlength.Parameters), Index=0, Wrap=True)
item_5 = ListItem(List=reverse(reldif), Index=0, Wrap=True)
item_6 = ListItem(List=reverse(divlength_2.Parameters), Index=0, Wrap=True)
item_7 = ListItem(List=reverse(reldif_2), Index=0, Wrap=True)
item_8 = ListItem(List=reverse(divlength_3.Parameters), Index=0, Wrap=True)
item_9 = ListItem(List=reverse(reldif_3), Index=0, Wrap=True)
addition = Addition(A=item_5, B=item_4)
addition_2 = Addition(A=item_7, B=item_6)
addition_3 = Addition(A=item_9, B=item_8)
merge = Merge(Data1=divlength.Parameters, Data2=addition)
merge_2 = Merge(Data1=divlength_2.Parameters, Data2=addition_2)
merge_3 = Merge(Data1=divlength_3.Parameters, Data2=addition_3)
crossref = CrossReference(ListA=merge, ListB=merge_3, CrossMode=1)  # -> ListA, ListB
box = EvaluateBox(Box=bbox.Box, UParameter=graft(merge_2), VParameter=crossref.ListA, WParameter=crossref.ListB)  # -> Plane, Point, Include
panel = Panel("Voxelize")
division = Division(A=num_3, B="2")
division_2 = Division(A=num_2, B="2")
division_3 = Division(A=num, B="2")
neg = Negative(Value=division)
neg_2 = Negative(Value=division_2)
neg_3 = Negative(Value=division_3)
dom = ConstructDomain(DomainStart=neg, DomainEnd=division)
dom_2 = ConstructDomain(DomainStart=neg_2, DomainEnd=division_2)
dom_3 = ConstructDomain(DomainStart=neg_3, DomainEnd=division_3)
crossref_2 = CrossReference(ListA=dom_2, ListB=dom, CrossMode=1)  # -> ListA, ListB
box_2 = DomainBox(Base=simplify(box.Plane), X=graft(dom_3), Y=crossref_2.ListA, Z=crossref_2.ListB)
minc = MeshInclusion(Mesh=mesh, Point=box.Plane, Strict=False)
sort = SortList(Keys=[num, num_2, num_3])  # -> Keys, ValuesA
cull = CullPattern(List=box_2, CullPattern=minc)
meshcp = MeshClosestPoint(Point=box.Plane, Mesh=mesh)  # -> Point, Index, Parameter
dist = Distance(PointA=box.Plane, PointB=meshcp.Point)
expression = Expression(a=sort.Keys, d=dist, Expression="if(d<sqrt(2*(a/2)^2),True,False)")
cull_2 = CullPattern(List=box_2, CullPattern=expression)
cull_3 = CullPattern(List=cull_2, CullPattern=bool)
merge_4 = Merge(Data1=cull, Data2=cull_3)
voxels = ClusterOutput(merge_4)  # Voxels to be filled with unit cells

# ==== cluster CrystallonV2CellType: A collection of pre-made unit cells

crv = Curve([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])
crv_2 = Curve([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])
crv_3 = Curve([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])
crv_4 = Curve([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])
crv_5 = Curve([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])
mesh = Mesh(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)
mesh_2 = Mesh(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)
mesh_3 = Mesh(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)
mesh_4 = Mesh([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])
crv_6 = Curve([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])
crv_7 = Curve([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])
crv_8 = Curve([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])
crv_9 = Curve([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])
crv_10 = Curve([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])
crv_11 = Curve([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])
crv_12 = Curve([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])
crv_13 = Curve([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])
crv_14 = Curve([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])
crv_15 = Curve([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])
crv_16 = Curve([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])
mesh_5 = Mesh(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)
mesh_6 = Mesh(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)
mesh_7 = Mesh(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)
mesh_8 = Mesh(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)
crv_17 = Curve([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])
crv_18 = Curve([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])
mesh_9 = Mesh(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)
geo = Geometry([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])
geo_2 = Geometry([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])
mesh_10 = Mesh([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])
panel = Panel("CELL TYPES")
entwine = Entwine(
    Branch00=crv_6,
    Branch01=crv_7,
    Branch02=crv,
    Branch03=crv_8,
    Branch04=crv_2,
    Branch05=crv_9,
    Branch06=crv_3,
    Branch07=crv_10,
    Branch08=crv_11,
    Branch09=crv_12,
    Branch010=crv_4,
    Branch011=crv_5,
    Branch012=crv_13,
    Branch013=crv_14,
    Branch014=crv_15,
    Branch015=crv_16,
    Branch016=mesh,
    Branch017=mesh_5,
    Branch018=mesh_6,
    Branch019=mesh_2,
    Branch020=mesh_7,
    Branch021=mesh_8,
    Branch022=crv_17,
    Branch023=crv_18,
    Branch024=mesh_9,
    Branch025=mesh_3,
    Branch026=geo,
    Branch027=mesh_4,
    Branch028=geo_2,
    Branch029=mesh_10,
    FlattenInputs=True)  # -> simplify(Result)
unit_cell_selector = ClusterInput()
branch = TreeBranch(Tree=entwine, Path=unit_cell_selector, MaintainPaths=True)
unit_cell = ClusterOutput(branch)  # Single unit cell to populate voxels

# ==== cluster CrystallonV2CellLatticeFill: Fill voxels with lattice unit cells

unit_cell = ClusterInput()  # Unit cell to populate voxels
voxels = ClusterInput()  # Voxels to be filled with unit cells
crv = Curve(unit_cell)
bbox = BoundingBox(Content=crv, Plane=PlaneXY(0, 0, 0), UnionBox=True)  # -> Box, Box_2
panel = Panel("CELL FILL")
morph = BoxMorph(Geometry=crv, Reference=bbox.Box, Target=graft(voxels))  # -> flatten(Geometry)
remove_duplicate_lines = RemoveDuplicateLines(lattice_l=flatten(morph))
lattice = ClusterOutput(remove_duplicate_lines)  # List of curves that make up the lattice

# ==== cluster RemoveDuplicateLines
lattice_l = ClusterInput()
crv = Curve(lattice_l)
curvepoint = PointOnCurve(crv, parameter=0.5)
cullpt = CullDuplicates(Points=curvepoint, Tolerance=".001", CullMode=1)  # -> Points, Indices, Valence
item = ListItem(List=crv, Index=cullpt.Indices, Wrap=True)
lattice = ClusterOutput(item)
