# Grasshopper definition 08.03.Data_driven_foot_dynamic_lattice.gh (Grasshopper 1.0.7)

# ---- group: Boxes
number_slider = Slider(5, range=0..10)
number_slider_2 = Slider(17, range=0..100)
number_slider_3 = Slider(9, range=0..10)
xy_plane = XYPlane(Origin=Point(0, 0, 0))
multiplication = Multiplication(A=number_slider_2, B=number_slider)
multiplication_2 = Multiplication(A=number_slider_3, B=number_slider)
rectangle = Rectangle(Plane=xy_plane, XSize=multiplication, YSize=multiplication_2, Radius=0)  # -> Rectangle, Length
number_slider_4 = Slider(2.5, range=0..10)
surface_frames = SurfaceFrames(Surface=rectangle.Rectangle, UCount=number_slider_2, VCount=number_slider_3)  # -> Frames, Parameters
center_box = CenterBox(Base=surface_frames.Frames, X=number_slider_4, Y=number_slider_4, Z=number_slider_4)

# ---- group: Input data
ghpython_script = GhPythonScript(filename="D:\\footPressure.csv")  # -> out, val
# ---------- ghpython_script: Python ----------
__author__ = "Yu Song"
__version__ = "2020.05.02"

import rhinoscriptsyntax as rs
import sys
#check inputs
print(filename)

#open file
f = open(filename,"r")

#empty list
text = []

#read file line by line
if f.mode == 'r':
    #read a line
    f1 = f.readlines()
    for x in f1:
        #print (x)
        #remove "\n" i.e. return in the graph
        temp = x.rstrip()
        #print (temp)
        #split text by comma "," 
        line_value = temp.split(',')
        #print(line_value)
        #append this line to the list
        text.append(line_value)
else:
    sys.exit("file is not ready")

#get number of rows
rows = len(text)

#get number of columns 
cols = len(text[0])
#print(cols)
data_complete = True  

for i in range (1, rows):
    if len(text[i]) != cols:
        data_complete = False

#check col number
#print(cols)

val = []

if not data_complete:
    sys.exit("file column numbers are not the same, check your file")
else:
    #prepare a 1D list, which has col * row components, col first, then row by row 
    #in this example we will read every two cells
    for i in range (1, rows, 2):
        number = len(text[i])
        #in this example we will read every two cells
        for j in range(0,20,2):
        #for each in text[i]:
            val.append(text[i][j])
print("data is ready")
# ---------- end ghpython_script ----------
panel = Panel(ghpython_script.val)

# ---- group: Map from pressure to number of points
flatten_tree = FlattenTree(Tree=ghpython_script.val, Path="{0}")
bounds = Bounds(Numbers=flatten_tree)
remap_numbers = RemapNumbers(Value=flatten_tree, Source=bounds, Target=Domain(0, 1))  # -> Mapped, Clipped
number_slider_5 = Slider(0, range=0..100)
graph_mapper = GraphMapper(
    remap_numbers.Mapped,
    x0=0,
    x1=1,
    y0=1,
    y1=2,
    container_name="Bezier",
    cpx=[0, 0.04627900943, 0.4355522692, 1],
    cpy=[0, 0.9079285264, 0.8056268096, 1])

# ---- group: Voronoi
populate_3d = Populate3D(Region=graft(center_box), Count=graft(graph_mapper), Seed=1)
bounding_box = BoundingBox(Content=flatten(center_box), Plane=PlaneXY(0, 0, 0), UnionBox=True)  # -> Box, Box_2
voronoi_3d = Voronoi3D(Points=flatten(populate_3d), Box=bounding_box.Box)  # -> flatten(Cells), Boundary

# ---- group: Lattice
mesh_edges = MeshEdges(Mesh=voronoi_3d.Cells)  # -> NakedEdges, InteriorEdges, NonManifoldEdges
pipe = Pipe(Radius=Slider(0.2, range=0..1), Caps=2)
