# Grasshopper definition Digital Fabrication Laser Cutting V2.gh (Grasshopper 1.0.7)
# plug-ins: Pufferfish, OpenNest

curve = Curve(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)
curve_2 = Curve(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)
curve_3 = Curve(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)
yz_plane = YZPlane(Origin=Point(0, 0, 0))
explode = Explode(Curve=curve_2, Recursive=True)  # -> Segments, Vertices
sweep2 = Sweep2(Rail1=curve_3, Rail2=curve_2, Sections=curve, SameHeight=False)
xz_plane = XZPlane(Origin=Point(0, 0, 0))
list_item = ListItem(List=explode.Vertices, Index=0, Wrap=True)  # -> Item, Item1
xz_plane_2 = XZPlane(Origin=list_item.Item1)
number_slider = Slider(7, range=0..10)
plane_surface = PlaneSurface(Plane=xz_plane_2, XSize=Domain(-100, 100), YSize=Domain(-100, 100))
split_brep = SplitBrep(Brep=sweep2, Cutter=plane_surface)
list_item_2 = ListItem(List=split_brep, Index=0, Wrap=True)
mirror = Mirror(Geometry=list_item_2, Plane=xz_plane)  # -> Geometry, Transform
brep_join = BrepJoin(Breps=[list_item_2, mirror.Geometry])  # -> Breps, Closed
bounding_box = BoundingBox(Content=brep_join.Breps, Plane=PlaneXY(0, 0, 0))  # -> Box, Box_2
deconstruct_brep = DeconstructBrep(Brep=bounding_box.Box)  # -> Faces, Edges, Vertices
deconstruct_brep_2 = DeconstructBrep(Brep=bounding_box.Box)  # -> Faces, Edges, Vertices
list_item_3 = ListItem(List=deconstruct_brep.Edges, Index=Slider(3, range=0..10), Wrap=True)
list_item_4 = ListItem(List=deconstruct_brep_2.Edges, Index=Slider(8, range=0..10), Wrap=True)
perp_frames = PerpFrames(Curve=list_item_3, Count=Slider(10, range=0..100), Align=True)  # -> Frames, Parameters
perp_frames_2 = PerpFrames(Curve=list_item_4, Count=Slider(6, range=0..100), Align=True)  # -> Frames, Parameters
brep_plane = BrepPlane(Brep=brep_join.Breps, Plane=perp_frames.Frames)  # -> Curves, Points
project = Project(Geometry=brep_plane.Curves, Plane=yz_plane)  # -> Geometry, Transform
brep_plane_2 = BrepPlane(Brep=brep_join.Breps, Plane=perp_frames_2.Frames)  # -> Curves, Points
project_2 = Project(Geometry=brep_plane_2.Curves, Plane=yz_plane)  # -> Geometry, Transform
edge_surface = EdgeSurface(CurveA=brep_plane.Curves, CurveB=project.Geometry)
edge_surface_2 = EdgeSurface(CurveA=brep_plane_2.Curves, CurveB=project_2.Geometry)  # -> flatten(Surface)
deconstruct_brep_3 = DeconstructBrep(Brep=edge_surface)  # -> Faces, Edges, Vertices
cull_index = CullIndex(List=flatten(edge_surface), Indices=Slider(0, range=0..100), Wrap=True)
cull_index_2 = CullIndex(List=edge_surface_2, Indices=Slider(0, range=0..100), Wrap=True)
last_index = LastIndex(List=cull_index)
list_item_5 = ListItem(List=flatten(edge_surface), Index=10, Wrap=True)
last_index_2 = LastIndex(List=cull_index_2)
cull_index_3 = CullIndex(List=cull_index, Indices=last_index, Wrap=True)
cull_index_4 = CullIndex(List=cull_index_2, Indices=last_index_2, Wrap=True)
xz_plane_3 = XZPlane(Origin=Point(0, 0, 0))

number_slider_2 = Slider(-2, range=-10..-2)
number_slider_3 = Slider(0.5, range=0..10)
plane_normal = PlaneNormal(Origin=Point(0, 0, 0), ZAxis=cull_index_3)
division = Division(A=number_slider_3, B=number_slider_2)
amplitude = Amplitude(Vector=xz_plane_3, Amplitude=division)
amplitude_2 = Amplitude(Vector=xz_plane_3, Amplitude=number_slider_3)
move = Move(Geometry=cull_index_3, Motion=amplitude)  # -> Geometry, Transform
extrude = Extrude(Base=move.Geometry, Direction=amplitude_2)

plane_normal_2 = PlaneNormal(Origin=Point(0, 0, 0), ZAxis=cull_index_4)
division_2 = Division(A=number_slider_3, B=number_slider_2)
amplitude_3 = Amplitude(Vector=plane_normal_2, Amplitude=division_2)
amplitude_4 = Amplitude(Vector=plane_normal_2, Amplitude=number_slider_3)
move_2 = Move(Geometry=cull_index_4, Motion=amplitude_3)  # -> Geometry, Transform
extrude_2 = Extrude(Base=move_2.Geometry, Direction=amplitude_4)

custom_preview = CustomPreview(
    Geometry=extrude,
    Material={diffuse=RGB(221, 160, 221), emission=RGB(66, 48, 66), shine=0.5, specular=RGB(255, 255, 255), transparency=0})  # disabled
cross_reference = CrossReference(ListListA=extrude, ListListB=extrude_2, CrossMode=1)  # -> ListListA, ListListB
deconstruct_brep_4 = DeconstructBrep(Brep=extrude)  # -> Faces, Edges, Vertices
panel = Panel(deconstruct_brep_4.Faces)
brep_brep = BrepBrep(BrepA=cross_reference.ListListA, BrepB=cross_reference.ListListB)  # -> Curves, Points
bounding_box_2 = BoundingBox(Content=brep_brep.Curves, Plane=PlaneXY(0, 0, 0), UnionBox=True)  # -> Box, Box_2
brep_edges = BrepEdges(Brep=bounding_box_2.Box)  # -> Naked, Interior, NonManifold
list_item_6 = ListItem(List=brep_edges.Interior, Index=0, Wrap=True)
length = Length(Curve=list_item_6)
division_3 = Division(A=length, B=Slider(2, range=0..10))
negative = Negative(Value=division_3)
unit_x = UnitX(Factor=division_3)
unit_x_2 = UnitX(Factor=negative)
move_3 = Move(Geometry=bounding_box_2.Box, Motion=unit_x)  # -> Geometry, Transform
move_4 = Move(Geometry=bounding_box_2.Box, Motion=unit_x_2)  # -> Geometry, Transform
solid_difference = SolidDifference(BrepsA=flatten(extrude_2), BrepsB=flatten(move_3.Geometry))
solid_difference_2 = SolidDifference(BrepsA=flatten(extrude), BrepsB=flatten(move_4.Geometry))
unit_x_3 = UnitX(Factor=Slider(0, range=0..100))
move_5 = Move(Geometry=solid_difference_2, Motion=unit_x_3)  # -> Geometry, Transform
merge = Merge(Data1=solid_difference, Data2=solid_difference_2)
area = Area(Geometry=solid_difference_2)  # -> Area, Centroid
area_2 = Area(Geometry=solid_difference)  # -> Area, Centroid
deconstruct_brep_5 = DeconstructBrep(Brep=move_5.Geometry)  # -> Faces, Edges, Vertices
xy_plane = XYPlane(Origin=area_2.Centroid)
xz_plane_4 = XZPlane(Origin=area.Centroid)
custom_preview_2 = CustomPreview(
    Geometry=[move_5.Geometry, solid_difference],
    Material={diffuse=RGB(221, 160, 221), emission=RGB(66, 48, 66), shine=0.5, specular=RGB(255, 255, 255), transparency=0})  # disabled
merge_2 = Merge(Data1=xy_plane, Data2=xz_plane_4)
number_slider_4 = Slider(100, range=0..100)
xy_plane_2 = XYPlane(Origin=Point(0, 0, 0))
pack_objects = PackObjects(Geo=flatten(merge), Plane=merge_2, X=1, Y=1, Tolerabce=0)  # -> Geo, Transformation
plane_surface_2 = PlaneSurface(Plane=xy_plane_2, XSize=number_slider_4, YSize=number_slider_4)
opennest = OpenNest(
    Sheets=plane_surface_2,
    Geo=pack_objects.Geo,
    Spacing=1,
    Placement=Slider(1, range=0..100),
    Tolerance=0.1,
    Rotations=Slider(4, range=0..100),
    Iterations=1,
    Seed=1,
    Reset=True,
    Run=False)  # -> Sheets, Geo, ID, Transform, IDS
xy_plane_3 = XYPlane(Origin=Point(0, 0, 0))
custom_preview_3 = CustomPreview(
    Geometry=[list_item_5, brep_join.Breps],
    Material={diffuse=RGB(221, 160, 221), emission=RGB(66, 48, 66), shine=0.5, specular=RGB(255, 255, 255), transparency=0})
explode_2 = Explode(Curve=opennest.Sheets, Recursive=True)  # -> Segments, Vertices
project_3 = Project(Geometry=opennest.Geo, Plane=xy_plane_3)  # -> Geometry, Transform
deconstruct_brep_6 = DeconstructBrep(Brep=project_3.Geometry)  # -> Faces, Edges, Vertices
curve_4 = Curve(deconstruct_brep_6.Edges)
