# Grasshopper definition ParametricSunglasses.gh (Grasshopper 1.0.7)

geo = Geometry(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)
pt = Point([Point(-74.4943488, 40.64971556, 70.55217062), Point(-79.41765781, 16.07671851, 93.76652828), Point(-61.64079722, -105.8299542, 68.61079034)])
pt_2 = Point(Point(-79.40630171, 17.61441631, 93.31172434))
pt_3 = Point(Point(-59.76385502, -66.4184036, 70.73848189))
area = Area(Geometry=geo)  # -> Area, Centroid

# ---- group: Center point
item = ListItem(List=pt, Index=0, Wrap=True)  # -> Item, Item1, Item2
yz = YZPlane(Origin=Point(0, 0, 0))
pt_4 = Point(item.Item2)
project = Project(Geometry=pt_4, Plane=yz)  # -> Geometry, Transform
dist = Distance(PointA=item.Item2, PointB=project.Geometry)
division = Division(A=dist, B=Slider(2.5, range=0..10))

# ----
scale = Scale(Geometry=geo, Center=area.Centroid, Factor=Slider(1000, range=0..1000))  # -> Geometry, Transform
ln = Line(StartPoint=pt_2, EndPoint=pt_3)
pline = PolyLine(Vertices=pt, Closed=False)
explode = Explode(Curve=pline, Recursive=True)  # -> Segments, Vertices
pipe = Pipe(Curve=pline, Radius=Slider(2, range=0..10), Caps=2)
item_2 = ListItem(List=explode.Vertices, Index=0, Wrap=True)  # -> Item, Item1, Item2
item_3 = ListItem(List=explode.Segments, Index=0, Wrap=True)  # -> Item, Item1
pdecon = Deconstruct(Point=item_2.Item2)  # -> XComponent, YComponent, ZComponent
neg = Negative(Value=Slider(6.9, range=0..100))
pln = Plane(item_3.Item1)
addition = Addition(A=pdecon.XComponent, B=division)
multiplication = Multiplication(A=neg, B=0.01745329252)
pt_5 = ConstructPoint(XCoordinate=addition, YCoordinate=pdecon.YComponent, ZCoordinate=pdecon.ZComponent)
xy = XYPlane(Origin=Point(0, 0, 0))
rotate = Rotate(Geometry=pln, Angle=multiplication, Plane=xy)  # -> Geometry, Transform
pl_origin = PlaneOrigin(Base=rotate.Geometry, Origin=pt_5)
cir = Circle(Plane=pl_origin, Radius=division)
neg_2 = Negative(Value=Slider(3.5, range=0..100))
vec = Vector(pl_origin)
subtraction = Subtraction(A=division, B=Slider(3, range=0..100))
pdecon_2 = Deconstruct(Point=pt_5)  # -> XComponent, YComponent, ZComponent
neg_3 = Negative(Value=Slider(4.6, range=0..10))
offset = OffsetCurve(Curve=cir, Distance=neg_2, Corners=1)
multiplication_2 = Multiplication(A=vec, B=neg_3)
addition_2 = Addition(A=pdecon_2.XComponent, B=subtraction)
addition_3 = Addition(A=pdecon_2.ZComponent, B=Slider(6.5, range=0..100))
merge = Merge(Data1=offset, Data2=cir)  # -> flatten(Result)
pt_6 = ConstructPoint(XCoordinate=addition_2, YCoordinate=pdecon_2.YComponent, ZCoordinate=addition_3)
loft = Loft(Curves=merge, Options={Adjust=False, Closed=False, LoftEnds=0, LoftSimp=0, LoftType=0, Rebuild=10, Refit=0.01})
cap = CapHoles(Brep=pipe)
mirror = Mirror(Geometry=pt_6, Plane=PlaneYZ(0, 0, 0))  # -> Geometry, Transform
extr = Extrude(Base=loft, Direction=multiplication_2)  # -> flatten(Extrusion)
merge_2 = Merge(Data1=extr, Data2=cap)  # -> flatten(Result)
ln_2 = Line(StartPoint=pt_6, EndPoint=mirror.Geometry)
join = BrepJoin(Breps=merge_2)  # -> Breps, Closed
pipe_2 = Pipe(Curve=ln_2, Radius=Slider(1.4, range=0..10), Caps=2)
mirror_2 = Mirror(Geometry=join.Breps, Plane=PlaneYZ(0, 0, 0))  # -> Geometry, Transform
merge_3 = Merge(Data1=join.Breps, Data2=mirror_2.Geometry, Data3=pipe_2)  # -> flatten(Result)
join_2 = BrepJoin(Breps=merge_3)  # -> Breps, Closed
preview = CustomPreview(Geometry=join_2.Breps, Material=ColourSwatch(SwatchColor=RGB(61, 61, 61)))
